# Grasshopper definition ActiveLightOptimizer_example.gh (Grasshopper 1.0.8)
# plug-ins: ActiveLightOptimizer.Components

# READ ME: ACTIVE LIGHT OPTIMIZER (ALO) - neutral example (nothing from anybody's project)
# A simple window: a square opening in a frame that TILTS (parameter 'tilt', 0..15 degrees, steers the beam) plus a louvre
# blade that CLOSES (parameter 'close', 0..100, drives the opening). Built with the ALO nodes: ALO Parameter x2, ALO Joint x2,
# ALO Body x2, ALO Room Target, ALO Scene -> node 'Active Light Optimizer' (input 'scene').
# 1. ALO Scene checks the mechanism and draws a pose preview (open / middle / closed). Look at it before you run.
# 2. The engine runs in an external CPython 3.9+: set the Windows variable ALO_PYTHON to python.exe, and ALO_EPW to the full path of
#    a .epw weather file (there is no default weather), or write both into %LOCALAPPDATA%\ActiveLightOptimizer\engine_config.json.
# 3. Plane = the window: Z axis = outward normal (+Y here; north = +Y, use the node input 'north' otherwise).
# 4. Turn 'run' ON. The first plan runs in the background (minutes); the node keeps answering meanwhile.
# 5. Read 'status' and 'a'. ring = tilt (deg), aperture = % closed. Units: metres.
name = Text("tilt")
min = Number(0)
max = Number(15)
steps = Integer(11)
name_2 = Text("close")
min_2 = Number(0)
max_2 = Number(100)
steps_2 = Integer(11)
name_3 = Text("jtilt")
axis = Curve(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)
parameter = Text("tilt")
gain = Number(1)
name_4 = Text("jclose")
axis_2 = Curve(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)
parameter_2 = Text("close")
gain_2 = Number(-0.5)
name_5 = Text("frame")
geometry = Brep([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])
role = Text("mouth")
mouth_curves = Curve(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)
name_6 = Text("blade")
geometry_2 = Brep(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)
role_2 = Text("blocker")
room = Geometry([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, Point(0, -2, 1.5)])
exterior_dir = Vector(Vector(0, 1, 0))
north_deg = Number(0)
window_plane_z_outward_normal = Plane(Plane(origin=(0, 0, 0), x=(0, 0, 1), y=(1, 0, 0)))
alo_parameter_tilt = ALOParameter(Name=name, Min=min, Max=max, Steps=steps)  # -> Param, Status
alo_parameter_close = ALOParameter(Name=name_2, Min=min_2, Max=max_2, Steps=steps_2)  # -> Param, Status
alo_joint_tilt = ALOJoint(Name=name_3, Axis=axis, Parameter=parameter, Gain=gain)  # -> Joint, Status
alo_joint_close = ALOJoint(Name=name_4, Axis=axis_2, Parameter=parameter_2, Gain=gain_2)  # -> Joint, Status
alo_body_frame = ALOBody(Name=name_5, Geometry=geometry, Role=role, Mouth_curves=mouth_curves, Chain=alo_joint_tilt.Joint)  # -> Body, Status
alo_body_blade = ALOBody(Name=name_6, Geometry=geometry_2, Role=role_2, Chain=[alo_joint_tilt.Joint, alo_joint_close.Joint])  # -> Body, Status
alo_room_target = ALORoomTarget(Room=room)  # -> Targets, Status
alo_scene = ALOScene(
    Params=[alo_parameter_tilt.Param, alo_parameter_close.Param],
    Joints=[alo_joint_tilt.Joint, alo_joint_close.Joint],
    Bodies=[alo_body_frame.Body, alo_body_blade.Body],
    Targets=alo_room_target.Targets,
    Exterior_dir=exterior_dir,
    North_deg=north_deg)  # -> Scene, Status, Report, Preview, Preview_labels, Areas
run = BooleanToggle(False)
days = Panel("171")
active_light_optimizer = ActiveLightOptimizer(Run=run, Windows=window_plane_z_outward_normal, Days=days, Scene=alo_scene.Scene)  # -> Ring, Aperture, Ids, Status, A
scene_status = Panel(alo_scene.Status)
status = Panel(active_light_optimizer.Status)
ring = Panel(active_light_optimizer.Ring)
aperture = Panel(active_light_optimizer.Aperture)
