# Grasshopper definition windowparam.gh (Grasshopper 1.0.8)

# ---- group: Building components (wire your geometry: you choose what is what - empty = worked out from the room)
# READ ME (building components): BUILDING COMPONENTS for the energy model - you choose what is what:
# right-click an input > Set Multiple Geometry, pick the Rhino objects (or wire Breps in).
# Surfaces count once; solids by their side facing the room. Glass or a door sitting in an
# uncut wall is taken out of that wall; a wall with the opening cut out is used as it is.
# Common walls (shared with a neighbour) carry no heat. Leave an input empty and that part is
# worked out from the room faces. Then BUILD scene, then RUN scan.
common_walls_shared_with_a_neighbour_no = Geometry()  # "Common walls (shared with a neighbour - no heat flow)"
glazing_windows_glazed_doors_roof_lights = Geometry()
floor_suspended_subfloor_space = Geometry()
walls_below_ground_retaining = Geometry()
external_walls_above_ground = Geometry()
floor_slab_on_ground = Geometry()
doors_opaque = Geometry()
roof_ceiling = Geometry()

# ---- group: WINDOW DESIGN (lab: any window)
# READ ME (window design): WINDOW DESIGN (lab) - describe ANY window for the lab planners
# One beam width for the whole year, the direction the window faces, its tilt (0 = wall window like today,
# 90 = skylight), how high it sits, its size and the blade option.  The panels show the design spec, the beam
# widths this window size can make cleanly, a warning when the width is outside that, and the planner command.
# Description only: it does NOT move your model - your own Facing, Beam width and size sliders stay yours.
# 'write' saves the spec to lab\out\design_spec.json for the planner.  Lab advice (M-011): 10-15 cm all year.
design_year_round_beam_width_m = Slider(0.1, range=0.01..0.6)
design_facing_deg_0_n_90_e_180_s_270_w = Slider(0, range=0..359)
design_tilt_deg_0_wall_window_90_skyligh = Slider(0, range=0..90)  # "Design: tilt (deg: 0 wall window, 90 skylight)"
design_level_above_today_s_sill_m = Slider(0, range=-0.5..2)
design_scale_of_the_whole_window = Slider(1, range=0.25..1.5)
design_window_width_factor_along_the_tub = Slider(1, range=0.5..1.5)  # "Design: window width factor (along the tube)"
design_blade_0_today_1_bottom_to_60_deg = Slider(0, range=0..2)  # "Design: blade (0 today, 1 bottom to 60 deg, 2 to 75 deg)"
design_write_spec_for_the_planner = BooleanToggle(False)
d_window_design = Python3Script(
    beam_w=design_year_round_beam_width_m,
    facing_deg=design_facing_deg_0_n_90_e_180_s_270_w,
    tilt_deg=design_tilt_deg_0_wall_window_90_skyligh,
    level_m=design_level_above_today_s_sill_m,
    scale=design_scale_of_the_whole_window,
    width_f=design_window_width_factor_along_the_tub,
    blade=design_blade_0_today_1_bottom_to_60_deg,
    write=design_write_spec_for_the_planner)  # -> out, spec, feasible, warn, run_cmd
# ---------- d_window_design: Python ----------
# --- lab\models\gh_window_design.py (MODELER, M-010 / M-011) as it was when added by the TESTER (T-006).
# Re-run lab\tools\add_window_design.py to reload it.
# -*- coding: utf-8 -*-
"""
gh_window_design.py - Grasshopper (Rhino 8, Python 3 script component): the DESIGN inputs of the window for the lab
planners (G1 / G2 / G1B).  NOT on the canvas yet: the TESTER adds it (only the TESTER drives Rhino).  No physics here.

Felix 2026-10-11: one beam width all year (a design choice), and the model must work for any window: any facing,
any level, narrower / wider or scaled-down windows.  These sliders only DESCRIBE the design; the planner run reads the
spec (lab\\out\\design_spec.json) - it does not move Felix's geometry (his own Facing / width inputs stay his).

Inputs (all optional):
  beam_w      year-round beam width (m), slider 0.03-0.40 (one value for the whole year, no width changes in use)
  facing_deg  compass bearing the window faces (0 N, 90 E, 180 S, 270 W); empty = the model's own
  level_m     window raised (+) above today's sill relative to the room floor (m), slider -0.5..2.0
  scale       uniform scale of the whole window assembly (tube, rings, blades, aperture, lip), slider 0.25-1.5
  width_f     window overall width factor (along the tube), slider 0.5-1.5
  tilt_deg    window tilt, slider 0-90: 0 = today's wall window (facing sideways), 90 = skylight in the ceiling
              (facing up), between = a sloped window across the wall/ceiling corner.  The window turns about its tube
              axis; at 90 the skylight sits as far in from the wall as the window centre sat below the ceiling
              (level_m moves it).  For a skylight facing_deg is its rotation in the ceiling (the direction it would
              face if turned back down to the wall); the rings tilt its tubes AWAY from that direction.  (M-011)
  blade       0 = today's coupled blades, 1 = bottom blade own drive to 60 deg, 2 = to 75 deg (design option, M-008)
  write       True = write lab\\out\\design_spec.json for the planner
Outputs:
  spec        the scenario JSON (scenario.py format) + blade
  feasible    "clean beams this window size can make: 0.03-0.31 m (5-95 %: ...)" when the lab has measured that size
  warn        text when beam_w is outside what this window size can make cleanly (the slider should be clamped)
  run_cmd     the command that plans the year with this spec (for the lab)
"""
import json
import os

LAB_OUT = r"C:\Users\felix\Documents\WindowOptimizer\lab\out"
PY = r"C:\Users\felix\miniconda3\python.exe"


def _g(name, default):
    v = globals().get(name)
    return default if v is None else v


def _feasible(scale_, width_f_):
    """Nearest measured window size in lab\\out\\gen_validate.json (gen_validate.py part W)."""
    p = os.path.join(LAB_OUT, "gen_validate.json")
    if not os.path.exists(p):
        return None
    d = json.load(open(p))
    best = None
    for k, v in d.items():
        if not k.startswith("feasible_") or v.get("clean_width_min_m") is None:
            continue
        s = v["spec"]
        dist = abs(s["scale"] - scale_) + abs(s["width_f"] - width_f_)
        if best is None or dist < best[0]:
            best = (dist, v)
    return best[1] if best and best[0] < 0.2 else None


def main():
    bw = float(_g("beam_w", 0.10))
    fac = _g("facing_deg", None)
    tilt = min(90.0, max(0.0, float(_g("tilt_deg", 0.0) or 0.0)))
    spec = {"facing": None if fac in (None, "") else float(fac) % 360.0, "level_m": float(_g("level_m", 0.0)),
            "scale": float(_g("scale", 1.0)), "width_f": float(_g("width_f", 1.0)), "beam_w": bw,
            "tilt_deg": round(tilt, 1)}
    bl = int(_g("blade", 0) or 0)
    blade_ = {0: None, 1: "b60", 2: "b75"}.get(bl)
    out = dict(spec, blade=blade_)
    fz = _feasible(spec["scale"], spec["width_f"])
    feas, wr = "not measured for this size yet (run gen_validate.py W)", ""
    if fz:
        feas = "clean beams this window size can make: %.3f-%.3f m (5-95 %%: %.3f-%.3f m)" % (
            fz["clean_width_min_m"], fz["clean_width_max_m"], fz["p05"], fz["p95"])
        if not (fz["p05"] <= bw <= fz["p95"]):
            wr = "beam_w %.3f m is outside the usual clean range %.3f-%.3f m for this window size" % (
                bw, fz["p05"], fz["p95"])
        if tilt > 0:
            feas += " (measured on the wall window; not yet measured for tilted windows)"
    if _g("write", False):
        with open(os.path.join(LAB_OUT, "design_spec.json"), "w") as f:
            json.dump(out, f, indent=1)
    cfg = {"SCEN": spec}
    if blade_:
        cfg["BLADE"] = blade_
    cmd = '%s glide.py G2 005 "%s"' % (PY, json.dumps(dict(cfg, DIPFILL=6, DWELL=13)).replace('"', '\\"'))
    return json.dumps(out), feas, wr, cmd


spec, feasible, warn, run_cmd = main()
# ---------- end d_window_design ----------
design_spec = Panel(d_window_design.spec)
design_feasible_widths = Panel(d_window_design.feasible)
design_warning = Panel(d_window_design.warn)
design_planner_command = Panel(d_window_design.run_cmd)

# ----
curve_aperture_axis_top = Curve(<curve referenced from the Rhino model>)
curve_aperture_axis_bottom = Curve(<curve referenced from the Rhino model>)
curve_ring_axis_1 = Curve(<curve referenced from the Rhino model>)
curve_ring_axis_3 = Curve(<curve referenced from the Rhino model>)
curve_ring_axis_2 = Curve(<curve referenced from the Rhino model>)
brep_aperture_top = Brep(<brep referenced from the Rhino model>)
brep_aperture_bottom = Brep(<brep referenced from the Rhino model>)
brep_ring_1 = Brep(<brep referenced from the Rhino model>)
brep_ring_3 = Brep(<brep referenced from the Rhino model>)
brep_ring_2 = Brep(<brep referenced from the Rhino model>)

# ---- group: LIGHT TARGET (lab preview)
# READ ME (light target): LIGHT TARGET (lab preview, round 2) - WHERE the beam can land
# Set a point in the room (depth from the window, offset to the right looking out, height above the floor).
# The summary says when today the sun can put the beam within the radius, and how near it gets.  Mode 1 =
# reach preview (path of the beam through the day, every 5 min, + the lit patch now); mode 2 = target-only
# (beam only near the target).  Preview only: nothing here changes the scan or the window.  To see the path
# in Rhino, turn 'Clean view' off.  Tables exist for 5 cm and 30 cm beams (lab\out\reach_w*.json).
light_target_depth_into_the_room_m_0_off = Slider(2.5, range=0..8)
light_target_offset_right_looking_out_m = Slider(0, range=-4..4)
light_target_height_above_floor_m = Slider(0, range=0..2)
light_target_reach_radius_m = Slider(0.5, range=0.1..2)
light_target_mode_0_off_1_reach_preview = Slider(1, range=0..2)  # "Light target mode: 0 off, 1 reach preview, 2 target-only"

# ---- group: Building energy inputs (entered by hand - the areas come from the geometry)
# READ ME (energy inputs): BUILDING ENERGY INPUTS - the energy calculator workbook's formulas, with:
#   areas   from the geometry (room faces, the window opening, 'Other glazing'), every scan
#   values  these sliders (the workbook's own numbers are placeholders)
#   climate 12 months for Newcastle: the workbook's Jan / Jul / Oct + published data
# Terms as in the NCC 2022: glazing = glass + frame; roof / roof light = 0-70 deg from
# horizontal, steeper = external wall; slab-on-ground vs suspended floor; floor area within
# the finished wall surfaces. RUN the scan after changing them.
u_glazing_incl_frame_w_m2k = Slider(0.9, range=0.5..6)
u_roof_ceiling_w_m2k = Slider(0.18, range=0.1..5)
u_external_walls_w_m2k = Slider(0.44, range=0.1..5)
u_external_walls_below_ground_w_m2k = Slider(0.44, range=0.1..5)
u_floor_w_m2k = Slider(0.85, range=0.1..5)
slab_on_ground_off_suspended_floor = BooleanToggle(True)
floor_below_the_ground_outside_m = Slider(0, range=0..5)
roof_solar_absorptance_0_23_light_0_79_d = Slider(0.4, range=0..1)  # "Roof solar absorptance (0.23 light .. 0.79 dark)"
roof_shading_r_1_open_0_5_trees_0_covere = Slider(0.5, range=0..1)  # "Roof shading r (1 open, 0.5 trees, 0 covered)"
glazing_g_value = Slider(0.7, range=0..1)
glazing_overshadowing_r_1_none_0_8_subur = Slider(0.8, range=0..1)  # "Glazing overshadowing r (1 none, 0.8 suburb, 0.5 CBD)"
sun_protection_jan_summer_1_none = Slider(0.2, range=0..1)
sun_protection_jul_winter_1_none = Slider(0.6, range=0..1)
sun_protection_oct_equinox_1_none = Slider(0.5, range=0..1)
air_changes_through_the_building_h = Slider(5, range=0..30)
ventilation_system_air_changes_h = Slider(0, range=0..5)
heat_recovery_of_that_system_0_0_95 = Slider(0, range=0..0.95)
occupants = Slider(4, range=0..50)
heat_per_person_w = Slider(80, range=0..200)
days_a_month_the_building_is_occupied = Slider(9, range=0..31)
fireplace_heater_w_0_none = Slider(0, range=0..10000)
thermal_mass_kj_m2k_of_floor_110_light_1 = Slider(165, range=80..370)  # "Thermal mass (kJ/m2K of floor: 110 light, 165 medium, 260 heavy)"
u_doors_w_m2k_only_for_doors_wired_in = Slider(2, range=0.5..6)

# ---- group: Time-lapse viewer
# READ ME (time-lapse): TIME-LAPSE VIEWER - the scan's result in Rhino's light
# 1 Pick a date + time (AEST = standard time; add 1 h for daylight saving Oct-Apr). Rhino's sun is set to
#   Newcastle at that moment and the window moves to the pose the scan chose for it.
# 2 PLAY runs time forward: 'Time step' simulated minutes every 'Frame interval' ms (nights skipped).
# 3 The building + window are copied to the Rhino layer 'Window time-lapse' so Rhino's lighting sees them;
#   Grasshopper previews are hidden meanwhile (Clean view). 'Go to camera view' = a view inside the room.
# 4 'Save frames' records the perspective view as PNGs + timelapse.html (out\timelapse) to play back;
#   'full Rhino Render' makes each saved frame a real render (~4 s, light bounces) - record, then play back.
# Sky light OFF = only the sun lights the room (the dark, beam-only look). Needs a finished scan.
month_1_12 = Slider(5, range=1..12)
day_1_31 = Slider(1, range=1..31)
hour_0_23_aest = Slider(10, range=0..23)
minute_0_59 = Slider(0, range=0..59)
play_time_lapse = BooleanToggle(False)
time_step_simulated_minutes_per_frame = Slider(10, range=0.1..240)
frame_interval_ms_of_real_time = Slider(200, range=50..3000)
skip_nights = BooleanToggle(True)
loop_this_day = BooleanToggle(False)
smooth_window_moves_eased_speed_limited = BooleanToggle(True)  # "Smooth window moves (eased, speed-limited; off = jump)"
set_rhino_sun_newcastle = BooleanToggle(True)
sky_light_soft_daylight_off_sun_beams_on = BooleanToggle(False)  # "Sky light (soft daylight; OFF = sun beams only, dark room)"
drive_window_sliders_ring_angle_aperture = BooleanToggle(True)  # "Drive window sliders (Ring Angle / Aperture Close)"
window_sliders_parameter_slider_name = Panel("""ring = Ring Angle
aperture = Aperture Close""")
save_frames_png_timelapse_html_in_out_ti = BooleanToggle(False)  # "Save frames (PNG + timelapse.html in out\timelapse)"
saved_frames_full_rhino_render_4_s_each = BooleanToggle(False)  # "Saved frames = full Rhino Render (~4 s each, light bounces)"
copy_building_window_into_rhino_for_the = BooleanToggle(True)  # "Copy building + window into Rhino (for the lit view)"
clean_view_hide_grasshopper_previews = BooleanToggle(True)
show_predicted_beam_outline = BooleanToggle(False)
go_to_the_time_lapse_camera_view = BooleanToggle(True)
display_mode_rendered_raytraced_empty_le = Panel("Rendered")  # "display mode: Rendered / Raytraced / empty = leave the view"
move_time_for_a_full_swing_minutes = Slider(1, range=0.1..10)
slow_motion_during_big_moves = BooleanToggle(True)
fine_transitions_movement_schedule_off_r = BooleanToggle(True)  # "Fine transitions (movement schedule; off = regular test schedule)"

# ---- group: Window size
# READ ME (window size): WINDOW SIZE - before everything else
# Bigger (up to +5 m): every part is cut through the middle of its straight runs and lengthened there -
# corners and curves keep their exact shape (nothing is scaled). Hinge axes move with it.
# Smaller: only the straight run all parts share is shortened, never more than half of it, so the
# curves are never reached - the sliders stop there (about 1.77 m narrower, 0.07 m lower).
# The WALL OPENING follows: the frame around it is resized the same way, the wall is cut back (or filled
# in) around it - the building keeps its size. The blades keep their size. After changing it: BUILD,
# then RUN the scan.
extra_width_m_wider_without_stretching_0 = Slider(5, range=-1.77..5)  # "Extra width (m): wider without stretching, 0 = as modelled"
extra_height_m_taller_without_stretching = Slider(0, range=-0.07..5)  # "Extra height (m): taller without stretching, 0 = as modelled"

# ---- group: Beam optimiser
# READ ME: HOW TO USE
# 1 Check/replace: code folder, weather file, 'exterior direction' (room -> outside), housing Brep.
# 2 Turn BUILD on, read 'build report' + check mouth_curves in Rhino, turn BUILD off.
# 3 Turn RUN on (canvas freezes ~1 min), read 'scan report', turn RUN off.
# 4 Drag 'Hour of year': pose_values (ring, aperture) + beam outlines update live.
# Facing / beam width / weights are sliders: turn RUN on again after changing them.
# Wire pose_values[0] -> Ring Angle input and [1] -> Aperture Close input to drive your window.
shading_context_on_turn_off_if_nothing_s = BooleanToggle(False)  # "Shading context ON (turn OFF if nothing shades the window)"
output_folder = Panel("C:\Users\felix\Documents\WindowOptimizer\out")
priority_0_thermal_comfort_1_light_beam = Slider(1, range=0..1)
beam_width_m = Slider(0.05, range=0.05..1)
code_folder = Panel("C:\Users\felix\Documents\WindowOptimizer")
weather_file_epw_replace_with_the_real_n = Panel("C:\Users\felix\Documents\WindowOptimizer\SYNTHETIC_TEST_ONLY.epw")  # "weather file (.epw) <- replace with the real Newcastle file"
scene_json = Panel("C:\Users\felix\Documents\WindowOptimizer\out\scene.json")
scene_resolved_json = Panel("C:\Users\felix\Documents\WindowOptimizer\out\scene_resolved.json")
schedule_csv = Panel("C:\Users\felix\Documents\WindowOptimizer\out\schedule.csv")
pose_grid_name_min_max_count = Panel("ring=0:15:11 aperture=0:100:11")
extra_settings_json_see_config_default_j = Panel("{}")  # "extra settings (json) - see config.default.json"
facing_deg_0_n_90_e_180_s_270_w = Slider(0, range=0..360)
time_step_minutes_1_minute_by_minute_60 = Slider(1, range=1..60)  # "Time step (minutes): 1 = minute by minute, 60 = hourly"
motion_smoothing_minutes_steadier_moves = Slider(25, range=0..60)  # "Motion smoothing (minutes): steadier moves, 0 = off"
target_indoor_temp_jan_degc = Slider(22.5, range=14..30)
target_indoor_temp_feb_degc = Slider(22.5, range=14..30)
target_indoor_temp_mar_degc = Slider(22.5, range=14..30)
target_indoor_temp_apr_degc = Slider(22.5, range=14..30)
target_indoor_temp_may_degc = Slider(22.5, range=14..30)
target_indoor_temp_jun_degc = Slider(22.5, range=14..30)
target_indoor_temp_jul_degc = Slider(22.5, range=14..30)
target_indoor_temp_aug_degc = Slider(22.5, range=14..30)
target_indoor_temp_sep_degc = Slider(22.5, range=14..30)
target_indoor_temp_oct_degc = Slider(22.5, range=14..30)
target_indoor_temp_nov_degc = Slider(22.5, range=14..30)
target_indoor_temp_dec_degc = Slider(22.5, range=14..30)
comfort_tolerance_degc = Slider(2.5, range=0.5..5)
run_scan_switch_on_to_start_it_runs_in_t = BooleanToggle(False)  # "RUN scan (switch on to start - it runs in the background)"
motion_penalty = Slider(0, range=0..0.2)
build_scene_turn_off_after = BooleanToggle(False)
exterior_direction_leave_empty_automatic = Vector()  # "exterior direction - leave EMPTY = automatic from the window (set a vector to override)"
additional_windows_one_plane_each_origin = Plane()  # "Additional windows: one plane each (origin = window centre, Z = the way it faces)"
building_context_shading_geometry_that_c = Geometry()  # "Building / context (shading) - geometry that can shade the window"
room_faces_breps_hero_zone_curves_option = Geometry([<brep referenced from the Rhino model> x18])  # "Room: faces (Breps) + hero-zone curves + optional point inside - one list"
room_faces_floor_walls_ceiling_optional = Brep([<brep referenced from the Rhino model> x18])  # "Room faces (floor, walls, ceiling) - optional, else placeholder room"
cancel_the_running_scan = BooleanToggle(False)
run_scans_in_the_background_grasshopper = BooleanToggle(True)  # "Run scans in the background (Grasshopper stays usable)"
temperature_energy_model_off_light_only = BooleanToggle(False)
break_up_moves_one_small_move_every_s_0 = Slider(5, range=0..30)  # "Break up moves: one small move every (s), 0 = off"
largest_small_move_of_a_full_swing = Slider(5, range=1..50)
brep_housing_fixed_frame = Brep(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)
beam_consistency_optimiser_off_v1_the_ea = BooleanToggle(True)  # "BEAM CONSISTENCY optimiser (off = v1, the earlier one)"
dropout_cost_beam_minutes_keep_the_beam = Slider(60, range=0..120)  # "Dropout cost (beam-minutes): keep the beam going"
beam_jump_cost_beam_minutes_per_metre = Slider(2, range=0..60)
hour_of_year_0_8759 = Slider(4139, range=0..8759)
_3_preview_hour = Python3Script(core_dir=code_folder, scene_path=scene_resolved_json, csv_path=schedule_csv, hoy=hour_of_year_0_8759)  # -> out, param_names, pose_values, sun_vec, beam_curves, room_curves, info, beam_point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
# ---------- _3_preview_hour: Python ----------
# -*- coding: utf-8 -*-
"""
gh_03_preview.py   -   Grasshopper "Python 3 Script" component (Rhino 8)
================================================================================
Scrub through the year: pick an hour, get the window pose(s) to feed into YOUR existing
definition, the sun vector, and the sunlight patches drawn on the room surfaces.  Works for one
window or several (each window gets its own pose and beam).

INPUTS
  core_dir     [str]    folder containing window_beams_core.py
  scene_path   [str]    scene_resolved.json from gh_02_run_scan (NOT the raw scene.json - the
                        resolved one carries the orientation and room that run used)
  csv_path     [str]    schedule.csv from gh_02_run_scan
  hoy          [int]    hour of year 0..8759 (a slider; 0 = Jan 1, 00:00-01:00)
  override     [float]  optional list - if given, use these pose values for the FIRST window instead of the
                        schedule (same order as its parameters) to try poses by hand

OUTPUTS
  window_names [str]    one per window
  param_names  [str]    one window: ring, aperture.  Several: w1_ring, w1_aperture, w2_ring, ...
  pose_values  [float]  chosen value per parameter, same order as param_names -> wire to the Ring Angle /
                        Aperture Close inputs of your definition (item 0, 1 for a single window)
  pose_tree    [float]  Tree: branch {window} = that window's pose values
  sun_vec      [Vector3d] direction TOWARD the sun
  beam_curves  [Curve]  closed outlines of the sunlight on the room surfaces (all windows)
  room_curves  [Curve]  outlines of the room faces (placeholder box or yours)
  beam_point   [Point3d] where the first window's beam lands (None when there is no beam)
  beam_points  [Point3d] one entry per window (None when that window has no beam)
  info         [str]    time, sun position, pose, beam score, widths, per window
"""
import sys
import csv
import json

import Grasshopper
from Grasshopper.Kernel.Data import GH_Path
import Rhino.Geometry as rg
import scriptcontext as sc

for _n in ("core_dir", "override"):
    globals().setdefault(_n, None)


def _rows(path):
    import os
    key = ("wbc_csv", path, os.path.getmtime(path))
    if key not in sc.sticky:
        with open(path) as f:
            sc.sticky[key] = list(csv.DictReader(f))
    return sc.sticky[key]


def main():
    if core_dir and core_dir not in sys.path:
        sys.path.insert(0, core_dir)
    import importlib
    import window_beams_core as core
    importlib.reload(core)

    with open(scene_path) as f:
        scene = json.load(f)
    wins = core.split_windows(scene)
    n = len(wins)
    row = _rows(csv_path)[int(hoy)]
    alt, az = float(row["sun_alt"]), float(row["sun_az"])
    s = core.sun_vector(alt, az, scene.get("north_deg", 0.0))

    names, vals, wnames, curves, points, tree = [], [], [], [], [], Grasshopper.DataTree[float]()
    lines = ["hoy %d  %s/%s %sh   sun alt %.1f az %.1f   DNI %s W/m2   outdoor %s C   INDOOR %s C" % (
        int(hoy), row["day"], row["month"], row["hour"], alt, az, row["dni"], row["temp"],
        row.get("indoor_temp", "-") or "-")]
    for k, w in enumerate(wins):
        pre = core.window_prefix(k, n)
        pn = [p["name"] for p in w["params"]]
        if override and k == 0:
            pv = [float(v) for v in override]
        else:
            pv = [float(row[pre + nm]) for nm in pn]
        pose = dict(zip(pn, pv))
        wnames.append(w.get("name") or "window %d" % (k + 1))
        names += [pre + nm for nm in pn]
        vals += pv
        for v in pv:
            tree.Add(v, GH_Path(k))
        polys = core.beam_polygons_3d(w, pose, alt, az) if alt > 0 else {}
        for plist in polys.values():
            for poly in plist:
                pl = rg.Polyline([rg.Point3d(*p) for p in poly])
                pl.Add(pl[0])
                curves.append(rg.PolylineCurve(pl))
        bx = row.get(pre + "beam_x", "")
        points.append(rg.Point3d(float(bx), float(row[pre + "beam_y"]), float(row[pre + "beam_z"]))
                      if bx not in ("", None) else None)
        fd = core.facing_of_scene(w if "north_deg" in w else dict(w, north_deg=scene.get("north_deg", 0.0)))
        lines.append("%spose %s\nbeam score %s   width %s m   length %s m   gain %s W\n"
                     "beam lands on: %s   at (%s, %s, %s)   absorbed %s W" % (
                         "" if n == 1 else "[%s, faces %s] " % (wnames[-1], core.compass_name(fd)),
                         ", ".join("%s=%.2f" % (nm, v) for nm, v in pose.items()),
                         row[pre + "beam_score"], row[pre + "beam_width_m"] or "-", row[pre + "beam_length_m"] or "-",
                         row[pre + "gain_w"], row[pre + "beam_target"] or "no beam", row.get(pre + "beam_x", "") or "-",
                         row.get(pre + "beam_y", "") or "-", row.get(pre + "beam_z", "") or "-",
                         row.get(pre + "beam_absorbed_w", "") or "-"))
    room = []
    for pts in core.targets_outline_3d(scene).values():
        pl = rg.Polyline([rg.Point3d(*p) for p in pts])
        pl.Add(pl[0])
        room.append(rg.PolylineCurve(pl))
    first = next((p for p in points if p is not None), None) if n > 1 else points[0]
    return wnames, names, vals, tree, rg.Vector3d(*s), curves, room, "\n".join(lines), first, points


window_names, param_names, pose_values, pose_tree, sun_vec, beam_curves, room_curves, info, beam_point, beam_points = main()
# ---------- end _3_preview_hour ----------
hour_info = Panel(_3_preview_hour.info)

# ---- group: Building energy inputs (entered by hand - the areas come from the geometry) (continued)
_7_energy_inputs = Python3Script(
    core_dir=code_folder,
    scene_path=scene_resolved_json,
    slab_on_ground=slab_on_ground_off_suspended_floor,
    u_glazing=u_glazing_incl_frame_w_m2k,
    u_roof=u_roof_ceiling_w_m2k,
    u_wall=u_external_walls_w_m2k,
    u_wall_earth=u_external_walls_below_ground_w_m2k,
    u_floor=u_floor_w_m2k,
    below_ground_m=floor_below_the_ground_outside_m,
    roof_absorptivity=roof_solar_absorptance_0_23_light_0_79_d,
    roof_reduction=roof_shading_r_1_open_0_5_trees_0_covere,
    g_value=glazing_g_value,
    r_obstruction=glazing_overshadowing_r_1_none_0_8_subur,
    sun_protection_jan=sun_protection_jan_summer_1_none,
    sun_protection_jul=sun_protection_jul_winter_1_none,
    sun_protection_oct=sun_protection_oct_equinox_1_none,
    n_rest=air_changes_through_the_building_h,
    n_system=ventilation_system_air_changes_h,
    heat_recovery=heat_recovery_of_that_system_0_0_95,
    occupants=occupants,
    w_per_person=heat_per_person_w,
    heating_days=days_a_month_the_building_is_occupied,
    fireplace_w=fireplace_heater_w_0_none,
    mass_kj_m2k=thermal_mass_kj_m2k_of_floor_110_light_1,
    u_door=u_doors_w_m2k_only_for_doors_wired_in)  # -> out, building, report
# ---------- _7_energy_inputs: Python ----------
# -*- coding: utf-8 -*-
"""
gh_07_energy_inputs.py   -   Grasshopper "Python 3 Script" component (Rhino 8)   "7 ENERGY INPUTS"
================================================================================
The building's values for the energy calculator formulas, ENTERED BY HAND (sliders / toggles).  The AREAS are not
entered: they come from the geometry - the components you wire into 1 BUILD SCENE (external walls, walls below
ground, common walls, roof, slab-on-ground, suspended floor, doors, glazing), and anything you leave empty from the
room faces + the window opening - and the scan works them out every run; this component previews them.  The
workbook's own numbers are placeholders; only its formulas are used.

Terms as the NCC 2022 uses them (Housing Provisions Schedule 1 + Part 13.2, Volume One Part J4):
  envelope          the fabric between the room and the outside (internal walls are not envelope)
  glazing / window  a transparent or translucent element AND its supporting frame; a window excludes roof lights
  roof light        glazing in a roof at 0-70 deg from the horizontal (the same 70 deg splits roof from external wall)
  external wall     an outer wall that is not a common wall; the part below the ground outside is earth-coupled
  slab-on-ground    a floor slab supported on the ground (AS 2870); otherwise a suspended floor over a subfloor space
  floor area        measured within the finished wall surfaces;  storey height floor to roof;  volume = area x height

INPUTS (all optional - empty = the workbook's placeholder value)
  core_dir, scene_path            code folder; scene_resolved.json (or scene.json) for the area preview
  u_glazing, u_roof, u_wall, u_wall_earth, u_floor, u_door   [float] U-values, W/m2K (glazing incl. frame; doors
                             only count when you wire doors into 1 BUILD SCENE)
  slab_on_ground    [bool]   True = slab-on-ground; False = suspended floor (outdoor air below)
  below_ground_m    [float]  how far the floor is below the ground outside (that much of each external wall touches
                             the earth)
  roof_absorptivity [float]  solar absorptance of the roof colour (0.23 reflective .. 0.79 dark - the workbook's note)
  roof_reduction    [float]  r: 1 unshaded roof, 0.5 shaded by trees, 0 under another roof
  g_value           [float]  glazing g-value (also the articulating window's glass)
  r_obstruction     [float]  overshadowing of the glazing by the surroundings (1 none, 0.8 suburbia, 0.5 CBD)
  sun_protection_jan, sun_protection_jul, sun_protection_oct   [float] eaves / louvres factor in summer, winter and
                             the equinox (1 = none); the other months follow a yearly curve through these
  n_rest, n_system, heat_recovery   [float] air changes / h through the building; of a ventilation system; its heat
                             recovery (0..0.95)
  occupants, w_per_person, heating_days, fireplace_w   [float] people, W each, days a month they are there, a
                             fireplace's W (0 = none)
  mass_kj_m2k       [float]  effective thermal mass per m2 of floor (not in the workbook - the hour-by-hour model
                             needs it): 80 very light, 110 light, 165 medium, 260 heavy, 370 very heavy
OUTPUTS
  building  [str]  the values as json -> 2 RUN SCAN.building
  report    [str]  the values + the areas the geometry gives
"""
import sys
import os
import json
import importlib

NUMS = ("u_glazing", "u_roof", "u_wall", "u_wall_earth", "u_floor", "u_door", "below_ground_m", "roof_absorptivity",
        "roof_reduction", "g_value", "r_obstruction", "n_rest", "n_system", "heat_recovery", "occupants",
        "w_per_person", "heating_days", "fireplace_w", "mass_kj_m2k")
for _n in ("core_dir", "scene_path", "slab_on_ground", "sun_protection_jan", "sun_protection_jul",
           "sun_protection_oct") + NUMS:
    globals().setdefault(_n, None)


def main():
    if core_dir and core_dir not in sys.path:
        sys.path.insert(0, core_dir)
    import building_energy as be
    import window_beams_core as core
    importlib.reload(be)
    importlib.reload(core)
    vals = {}
    for k in NUMS:
        v = globals().get(k)
        if v is not None:
            vals[k] = float(v)
    if slab_on_ground is not None:
        vals["slab_on_ground"] = bool(slab_on_ground)
    sp = dict((m, globals().get(k)) for m, k in (("1", "sun_protection_jan"), ("7", "sun_protection_jul"),
                                                    ("10", "sun_protection_oct")) if globals().get(k) is not None)
    if sp:
        vals["r_sun_protection"] = dict(be.DEFAULT_MANUAL["r_sun_protection"], **dict((m, float(v))
                                                                                   for m, v in sp.items()))
    lines = []
    env = None
    if scene_path and os.path.exists(scene_path):
        with open(scene_path) as f:
            scene = json.load(f)
        if not scene.get("targets"):
            scene = core.resolve_scene(scene, core.make_params())          # the placeholder room the scan would use
        env = core.building_envelope(scene, vals)
    lines += core.envelope_lines(env, vals) if env else ["   (no scene yet - BUILD first; areas are worked out by the scan)"]
    spec = be.spec_from_inputs(vals, env, be.newcastle_climate()) if env else None
    if spec:
        b = be.Building(spec)
        lines.insert(0, "heat loss %.1f W/K (glazing %.1f, roof %.1f, walls/floor to air %.1f, to earth %.1f, ventilation "
                        "%.1f); thermal mass %.1f MJ/K, time constant %.0f h" % (
                            b.h_total, b.h_glazing, b.h_roof, b.h_air, b.h_earth, b.h_vent, b.cap / 1e6,
                            b.time_constant_h))
    return json.dumps(vals, sort_keys=True), "\n".join(l.strip() for l in lines)


building, report = main()
# ---------- end _7_energy_inputs ----------
energy_inputs_areas_from_the_geometry = Panel(_7_energy_inputs.report)

# ---- group: Window size (continued)
_0_window_size = Python3Script(
    core_dir=code_folder,
    extra_width=extra_width_m_wider_without_stretching_0,
    extra_height=extra_height_m_taller_without_stretching,
    housing=brep_housing_fixed_frame,
    ring1=brep_ring_1,
    ring2=brep_ring_2,
    ring3=brep_ring_3,
    blade_top=brep_aperture_top,
    blade_bottom=brep_aperture_bottom,
    axis_ring1=curve_ring_axis_1,
    axis_ring2=curve_ring_axis_2,
    axis_ring3=curve_ring_axis_3,
    axis_blade_top=curve_aperture_axis_top,
    axis_blade_bottom=curve_aperture_axis_bottom,
    room=[room_faces_breps_hero_zone_curves_option, room_faces_floor_walls_ceiling_optional])  # -> out, report, sized_housing, sized_ring1, sized_ring2, sized_ring3, sized_blade_top, sized_blade_bottom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; inputs housing: list of Brep, ring1: list of Brep, ring2: list of Brep, ring3: list of Brep, blade_top: list of Brep, blade_bottom: list of Brep, axis_ring1: list of Curve, axis_ring2: list of Curve, axis_ring3: list of Curve, axis_blade_top: list of Curve, axis_blade_bottom: list of Curve, room: list of GeometryBase
# ---------- _0_window_size: Python ----------
# -*- coding: utf-8 -*-
"""
gh_00_resize_window.py   -   Grasshopper "Python 3 Script" component (Rhino 8)   "0 WINDOW SIZE"
================================================================================
Makes the whole window wider / taller - or a little smaller - WITHOUT stretching it.

Bigger: every part (housing, the three rings, both blades) is cut through the middle of its straight runs - a
vertical cut for width, a horizontal cut for height - the halves move apart and the gap is filled with a straight
extension of the cut.  The rounded corners and every curve keep their exact shape; only the flat sections get
longer.  The hinge axes move with their half and get longer with the width.

Smaller (negative values): only the straight run around the middle that ALL parts share is shortened - the stretch
where no curved face starts or ends.  The rest moves in rigidly.  It is capped so 10 % of that run (2 cm or more)
stays: the curves are never reached.  Asking for more does the most it can, and the report says so (and shows the
limits: on your window ~3 m narrower, ~0.12 m lower - the ring sides have only a short straight run).

The WALL OPENING follows: the frame piece around the opening in the room geometry is resized the same way, the wall
pieces around it are cut back where the bigger frame now reaches (or a strip is filled where a smaller one leaves a
gap); the building itself keeps its size (window_resize.resize_opening).

The blades keep their size: they move with the top / bottom, so extra height leaves a wider gap between them when
closed.  It sits before every other node: the hinged chain (RotAx), 1 BUILD SCENE and 6 RENDER SYNC all read its
outputs.  At 0 / 0 the parts pass through untouched.  After changing the size: BUILD (rebuild scene.json), then RUN
the scan - a new size is a new window.

INPUTS
  core_dir      [str]    folder containing window_resize.py
  extra_width   [float]  metres added to the width  (negative = narrower)
  extra_height  [float]  metres added to the height (negative = lower)
  housing, ring1, ring2, ring3, blade_top, blade_bottom  [Brep, list]  the window as modelled
  axis_ring1, axis_ring2, axis_ring3, axis_blade_top, axis_blade_bottom  [Curve, list]  the hinge axes
  room          [list]   OPTIONAL the room geometry (the same piece wired twice counts once; curves / points pass)
OUTPUTS
  report        [str]
  sized_housing, sized_ring1, ... sized_blade_bottom    [Brep]   the resized parts
  sized_axis_ring1, ... sized_axis_blade_bottom          [Curve]  the moved / lengthened hinge axes
  sized_room    [Brep]  the room with the wall opening matching the window
"""
import sys
import importlib

import System
import Rhino
import Rhino.Geometry as rg
import scriptcontext as sc

PARTS = ("housing", "ring1", "ring2", "ring3", "blade_top", "blade_bottom")
AXES = ("axis_ring1", "axis_ring2", "axis_ring3", "axis_blade_top", "axis_blade_bottom")
for _n in ("core_dir", "extra_width", "extra_height", "room") + PARTS + AXES:
    globals().setdefault(_n, None)


def _unique(breps):
    """The same piece wired in twice (two parameters holding the same geometry) counts once."""
    out, seen = [], set()
    for b in breps:
        bb = b.GetBoundingBox(True)
        key = (b.Faces.Count, round(bb.Min.X, 4), round(bb.Min.Y, 4), round(bb.Min.Z, 4), round(bb.Max.X, 4),
               round(bb.Max.Y, 4), round(bb.Max.Z, 4))
        if key not in seen:
            seen.add(key)
            out.append(b)
    return out


def _list(v):
    if v is None:
        return []
    return [getattr(x, "Value", x) for x in (v if isinstance(v, (list, tuple)) else [v]) if x is not None]


def _geo(g):
    """Objects referenced from the Rhino file arrive as bare Guids on an untyped input - get their geometry."""
    if isinstance(g, System.Guid):
        o = Rhino.RhinoDoc.ActiveDoc.Objects.FindId(g) if Rhino.RhinoDoc.ActiveDoc else None
        return o.Geometry if o is not None else None
    return g


def main():
    if core_dir and core_dir not in sys.path:
        sys.path.insert(0, core_dir)
    import window_resize as wr
    importlib.reload(wr)
    cache = sc.sticky.setdefault("window_resize_band_cache", {})     # straight runs, per geometry (slow to find)
    parts = dict((n, [b for b in _list(globals()[n]) if isinstance(b, rg.Brep)]) for n in PARTS)
    axes = dict((n, [c for c in _list(globals()[n]) if isinstance(c, rg.Curve)]) for n in AXES)
    dw, dh = float(extra_width or 0.0), float(extra_height or 0.0)
    out = dict(("sized_" + n, v) for n, v in list(parts.items()) + list(axes.items()))
    room_all = [g for g in (_geo(x) for x in _list(room)) if g is not None]
    room_in = _unique([b for b in room_all if isinstance(b, rg.Brep)])
    room_extra = [g for g in room_all if not isinstance(g, rg.Brep)]        # hero-zone curves, point inside: as is
    out["sized_room"] = [b.DuplicateBrep() for b in room_in] + room_extra  # copies: the Rhino objects stay untouched
    if not any(parts.values()):
        out["report"] = "no window parts connected"
        return out
    tol = Rhino.RhinoDoc.ActiveDoc.ModelAbsoluteTolerance if Rhino.RhinoDoc.ActiveDoc else 0.001
    centre, wdir, hdir, (w0, h0) = wr.window_frame(parts, axes)
    lw, lh, bw, bh = wr.limits(parts, centre, wdir, hdir, tol, cache)
    limit_line = ("can be up to %.2f m narrower and %.2f m lower without reaching the curves (straight runs "
                  "%.2f m across, %.2f m up the sides; any amount bigger)" % (lw, lh, bw[1] - bw[0], bh[1] - bh[0]))
    if abs(dw) < 1e-9 and abs(dh) < 1e-9:
        out["report"] = ("window size as modelled: %.3f m wide x %.3f m tall (housing) - the curves keep their shape "
                         "at any size.\n%s" % (w0, h0, limit_line))
        return out
    new_p, new_a, notes = wr.resize(parts, dict((n, c[0]) for n, c in axes.items() if c), dw, dh,
                                    centre, wdir, hdir, tol, cache)
    for n in PARTS:
        out["sized_" + n] = new_p[n]
    for n in AXES:
        if n in new_a:
            out["sized_" + n] = [new_a[n]] + axes[n][1:]
    _, _, _, (w1, h1) = wr.window_frame(new_p, dict((n, [c]) for n, c in new_a.items()))
    lines = ["window size: asked %+.3f m wide, %+.3f m tall  ->  housing %.3f x %.3f m (was %.3f x %.3f)"
             % (dw, dh, w1, h1, w0, h0),
             "corners and curves unchanged; " + limit_line,
             "next: BUILD (1 BUILD SCENE) then RUN the scan - a new size is a new window."]
    lines += notes or ["all parts joined cleanly (closed parts stay closed)"]
    if room_in:                                   # the wall opening follows the size the window actually got
        housing0 = (parts["housing"] or [b for n in PARTS for b in parts[n]])[0]
        key = (round(w1 - w0, 6), round(h1 - h0, 6), wr._sig(housing0), tuple(wr._sig(b) for b in room_in))
        memo = sc.sticky.setdefault("window_resize_opening", {})    # slider drags re-run this: keep the last result
        if key not in memo:
            memo.clear()
            memo[key] = wr.resize_opening(room_in, housing0, centre, wdir, hdir, w1 - w0, h1 - h0, tol, cache)
        new_room, onotes = memo[key]
        out["sized_room"] = [b.DuplicateBrep() for b in new_room] + room_extra
        lines += onotes
    else:
        lines.append("the wall opening keeps its size: wire the room geometry into 'room' to have it follow")
    out["report"] = "\n".join(lines)
    return out


_res = main()
report = _res.get("report")
for _n in PARTS + AXES + ("room",):
    globals()["sized_" + _n] = _res.get("sized_" + _n)
# ---------- end _0_window_size ----------
window_size_report = Panel(_0_window_size.report)

# ---- group: Hinged chain — aperture first, outer ring last
aperture_close = Slider(10, range=0..100)
ring_angle = Slider(6, range=0..15)
expression = Expression(x=flatten(aperture_close), Expression="-x*35/100")
expression_2 = Expression(x=flatten(aperture_close), Expression="x*30/100")
rad = Radians(Degrees=flatten(ring_angle))
rad_2 = Radians(Degrees=flatten(expression_2))
rad_3 = Radians(Degrees=flatten(expression))
end = EndPoints(Curve=flatten(_0_window_size.sized_axis_ring2))  # -> Start, End
rotax = RotateAxis(
    Geometry=flatten(_0_window_size.sized_blade_bottom),
    Angle=flatten(rad_2),
    Axis=flatten(_0_window_size.sized_axis_blade_bottom))  # -> Geometry, Transform
rotax_2 = RotateAxis(
    Geometry=flatten(_0_window_size.sized_blade_top),
    Angle=flatten(rad_3),
    Axis=flatten(_0_window_size.sized_axis_blade_top))  # -> Geometry, Transform
merge = Merge(Data1=flatten(_0_window_size.sized_ring3), Data2=flatten([rotax_2.Geometry, rotax.Geometry]))
ln = Line(StartPoint=flatten(end.End), EndPoint=flatten(end.Start))
rotax_3 = RotateAxis(Geometry=flatten(merge), Angle=flatten(rad), Axis=flatten(_0_window_size.sized_axis_ring3))  # -> Geometry, Transform
merge_2 = Merge(Data1=flatten(_0_window_size.sized_ring2), Data2=flatten(rotax_3.Geometry))
rotax_4 = RotateAxis(Geometry=flatten(merge_2), Angle=flatten(rad), Axis=flatten(ln))  # -> Geometry, Transform
merge_3 = Merge(Data1=flatten(_0_window_size.sized_ring1), Data2=flatten(rotax_4.Geometry))
rotax_5 = RotateAxis(Geometry=flatten(merge_3), Angle=flatten(rad), Axis=flatten(_0_window_size.sized_axis_ring1))  # -> Geometry, Transform

# ---- group: Time-lapse viewer (continued)
_5_time_lapse_clock = Python3Script(
    core_dir=code_folder,
    scene_path=scene_resolved_json,
    csv_path=schedule_csv,
    month=month_1_12,
    day=day_1_31,
    hour=hour_0_23_aest,
    minute=minute_0_59,
    play=play_time_lapse,
    step_minutes=time_step_simulated_minutes_per_frame,
    frame_ms=frame_interval_ms_of_real_time,
    skip_night=skip_nights,
    loop_day=loop_this_day,
    smooth=smooth_window_moves_eased_speed_limited,
    set_sun=set_rhino_sun_newcastle,
    sky_light=sky_light_soft_daylight_off_sun_beams_on,
    drive_window=drive_window_sliders_ring_angle_aperture,
    window_sliders=window_sliders_parameter_slider_name,
    save_frames=save_frames_png_timelapse_html_in_out_ti,
    render_frames=saved_frames_full_rhino_render_4_s_each,
    move_minutes=move_time_for_a_full_swing_minutes,
    slow_moves=slow_motion_during_big_moves,
    fine_moves=fine_transitions_movement_schedule_off_r)  # -> out, info, time_text, t_hours, hoy, sun_vec, sun_alt, sun_az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
# ---------- _5_time_lapse_clock: Python ----------
# -*- coding: utf-8 -*-
"""
gh_05_timelapse.py   -   Grasshopper "Python 3 Script" component (Rhino 8)   "5 TIME-LAPSE CLOCK"
================================================================================
Pick a date and time and this puts the scan's result on screen for that moment:
  * Rhino's SUN is set to Newcastle NSW at that date and time (north matched to the scan), and
  * your WINDOW is moved to the pose the scan chose: it drives your 'Ring Angle' / 'Aperture Close' sliders
    (window 1) and outputs the pose of every window for 6 RENDER SYNC.
Turn PLAY on and time runs forward by `step_minutes` every `frame_ms` milliseconds - a time-lapse of the light and
the mechanism.  Nights can be skipped, one day can be looped, and every frame of the active Rhino view can be
saved as a PNG (with timelapse.html to play them back in any browser).

Times are local STANDARD time (AEST, UTC+10), like the weather file and the scan.  During daylight saving
(Oct-Apr) the wall clock reads one hour later.

The window follows the scan's schedule at the scan's own resolution (every minute after a minute-by-minute scan;
read from poses_by_step.json next to csv_path).  Each change of setting is shown as a physical MOVE: it starts
when the schedule changes, eases in and out, and a full swing takes `move_minutes` (smaller moves take
proportionally less).  With `slow_moves` the clock slows down while a big move is under way so you see it happen
even when a frame normally skips many minutes.  When the scan BROKE UP its moves (break_up_every_s) the window
plays them as they are - small moves a few seconds apart - and slow motion shows one frame per small move.

INPUTS
  core_dir       [str]   folder containing window_beams_core.py
  scene_path     [str]   scene_resolved.json written by the scan
  csv_path       [str]   schedule.csv written by the scan (the 8760-row one in the output folder)
  month, day     [int]   start date (1-12, 1-31)
  hour, minute   [int]   start time, AEST
  play           [bool]  run the clock
  step_minutes   [float] simulated minutes per frame              (default 10)
  frame_ms       [int]   real milliseconds between frames          (default 200)
  skip_night     [bool]  jump from sunset to the next sunrise       (default True)
  loop_day       [bool]  replay the chosen day from the start time  (default False)
  smooth         [bool]  smooth, eased, speed-limited moves between settings; False = jump (default True)
  move_minutes   [float] how long a full swing of the mechanism takes, minutes (default 1.0)
  slow_moves     [bool]  slow the clock down during big moves (>= 10% of a full swing) (default True)
  fine_moves     [bool]  play the MOVEMENT schedule - the scan's changes broken up into small moves a few seconds
                         apart (when the scan has it: 'Break up moves' sliders or break_up_moves.py); False = the
                         regular test schedule, one move per change (default True)
  set_sun        [bool]  set Rhino's sun                            (default True)
  sky_light      [bool]  Rhino's sky light (soft daylight from the whole sky). Off = only the sun lights the room:
                         dark interior, hard beams (default False)
  drive_window   [bool]  move the window sliders                    (default True)
  window_sliders [str]   which slider is which, one per line: "ring = Ring Angle" (default: found by name)
  save_frames    [bool]  save a frame of the perspective view every step (+ timelapse.html to play them, and
                         frames.json with each frame's exact time and window settings)
  render_frames  [bool]  saved frames are full Rhino Renders (a few seconds each, light bounces round the room)
                         instead of the view as shown (default False)
  frames_dir     [str]   where to save (default: <folder of csv_path>/timelapse); each recording = new folder
  lat, lon, tz   [float] location (default Newcastle NSW: -32.93, 151.78, UTC+10)

OUTPUTS
  info           [str]   date/time, sun, weather, pose and beam of every window, what was set
  time_text      [str]   '22 Jun 11:30 AEST'
  t_hours        [float] hours since 1 Jan 00:00
  hoy            [int]   hour of the year (row of schedule.csv)
  sun_vec        [Vector3d] toward the sun
  sun_alt, sun_az [float] degrees
  window_names, param_names, pose_values, pose_tree   (as in 3 PREVIEW HOUR, at this exact moment)
  poses_json     [str]   -> 6 RENDER SYNC
  beam_curves    [Curve] the scan's predicted sunlight outlines at this moment
  frames_folder  [str]   folder of the current recording
"""
import sys
import os
import csv
import json
import time

import Grasshopper
from Grasshopper.Kernel.Data import GH_Path
import Rhino.Geometry as rg
import scriptcontext as sc

for _n in ("core_dir", "scene_path", "csv_path", "month", "day", "hour", "minute", "play", "step_minutes",
           "frame_ms", "skip_night", "loop_day", "smooth", "move_minutes", "slow_moves", "set_sun", "sky_light",
           "drive_window", "window_sliders", "save_frames", "render_frames", "frames_dir", "lat", "lon", "tz",
           "fine_moves"):
    globals().setdefault(_n, None)

BIG_MOVE = 0.1          # share of a full swing that counts as a big move (slow motion)


def _opt(v, default):
    return default if v is None else v


def _cached(kind, path, loader):
    key = ("wbc_" + kind, path, os.path.getmtime(path))
    if key not in sc.sticky:
        for k in [k for k in sc.sticky.keys() if isinstance(k, tuple) and k[:2] == key[:2]]:
            del sc.sticky[k]                                      # drop older versions of the same file
        sc.sticky[key] = loader(path)
    return sc.sticky[key]


def _read_rows(path):
    with open(path) as f:
        return list(csv.DictReader(f))


def _read_json(path):
    with open(path) as f:
        return json.load(f)


def _component():
    try:
        return ghenv.Component                                   # noqa: F821  (provided by Grasshopper)
    except NameError:
        return None


def _poses_file(csv_path):
    return os.path.join(os.path.dirname(os.path.abspath(csv_path)), "poses_by_step.json")


def _schedule(core, csv_path, rows, wins, fine=True):
    """Every window's schedule as runs: from poses_by_step.json (the scan's own time step) when it belongs to the
    same scan as csv_path, else from the hourly csv.  fine=True plays the MOVEMENT schedule (moves broken up into
    small ones, when the scan has it), False the regular test schedule.
    -> {"step_min", "source", "windows": [{names, runs, starts, ranges, series, series_starts, every_h}]}"""
    pj = _poses_file(csv_path)
    if os.path.exists(pj) and os.path.getmtime(pj) >= os.path.getmtime(csv_path) - 120:
        data = _cached("poses", pj, _read_json)
        if len(data["windows"]) == len(wins):
            out = {"step_min": data["step_min"], "source": "poses_by_step.json", "windows": [], "fine": None}
            for w in data["windows"]:
                bu = w.get("break_up") or {}             # moves broken up into small ones: the series of them
                runs, series = w["runs"], bu.get("series") or []
                if bu and not fine:                      # the regular test schedule instead
                    runs, series, bu = w.get("runs_scheduled") or runs, [], {}
                if bu:
                    out["fine"] = bu
                out["windows"].append({"names": w["params"], "runs": runs, "ranges": w["ranges"],
                                       "starts": core.run_starts(runs, data["step_min"]),
                                       "series": series, "series_starts": [s[0] for s in series],
                                       "every_h": float(bu.get("every_s") or 0.0) / 3600.0})
            out["has_fine"] = any(w.get("break_up") for w in data["windows"])
            return out
    n = len(wins)
    out = {"step_min": 60, "source": "hourly csv", "windows": [], "fine": None, "has_fine": False}
    for k, w in enumerate(wins):
        pre = core.window_prefix(k, n)
        pn = [p["name"] for p in w["params"]]
        series = core.schedule_poses(rows, [pre + nm for nm in pn])
        runs, prev = [], None
        for i, v in enumerate(series):
            if v != prev:
                runs.append([i] + list(v))
                prev = v
        ranges = [max(max(p["values"]) - min(p["values"]), 1e-9) for p in w["params"]]
        out["windows"].append({"names": pn, "runs": runs, "ranges": ranges, "starts": core.run_starts(runs, 60)})
    return out


def _pose(core, wsched, t, cfg):
    return core.window_pose_at(wsched["runs"], wsched["starts"], t, wsched["ranges"], cfg["move_min"], cfg["smooth"])


def _frame_step_h(core, st, t):
    """Simulated hours to the next frame: the normal step, or short steps while a big move is under way (and a
    frame exactly when one starts), so the movement is seen."""
    cfg = st["cfg"]
    step_h = cfg["step"] / 60.0
    if not (cfg["smooth"] and cfg["slow_moves"] and cfg["move_min"] > 0):
        return step_h
    fine = cfg["move_min"] / 60.0 / 8.0                          # ~8 frames per full swing
    wins = st["sched"]["windows"]
    if max(_pose(core, w, t, cfg)[1] for w in wins) >= BIG_MOVE:
        return min(step_h, fine)
    for w in wins:                    # moves broken up into small ones: one frame per small move of a big series
        s = core.series_at(w.get("series") or [], w.get("series_starts") or [], t)
        if s is not None and s[2] >= BIG_MOVE and w.get("every_h"):
            return min(step_h, w["every_h"])
    nxt = [core.next_big_change(w["runs"], w["starts"], t, t + step_h, w["ranges"], BIG_MOVE) for w in wins]
    nxt += [core.next_big_series(w.get("series") or [], w.get("series_starts") or [], t, t + step_h, BIG_MOVE)
            for w in wins]
    nxt = [x for x in nxt if x is not None and x > t + 1e-9]
    return min(nxt) - t if nxt else step_h


# ----------------------------------------------------------------------------- sliders of your definition
def _slider_map(names, text):
    """{param name: GH_NumberSlider}; explicit 'name = slider nickname' lines win, else the one slider whose
    nickname contains the parameter name."""
    comp = _component()
    if comp is None:
        return {}, ["no Grasshopper document"]
    import Grasshopper.Kernel.Special as sp
    doc = comp.OnPingDocument()
    sliders = [o for o in doc.Objects if isinstance(o, sp.GH_NumberSlider)]
    explicit = {}
    for line in (text or "").replace(";", "\n").splitlines():
        if "=" in line:
            a, b = line.split("=", 1)
            explicit[a.strip()] = b.strip()
    out, notes = {}, []
    for nm in names:
        if nm in explicit:
            cand = [s for s in sliders if s.NickName == explicit[nm]]
        else:
            cand = [s for s in sliders if nm.lower() in s.NickName.lower()]
        if len(cand) == 1:
            out[nm] = cand[0]
        elif cand:
            notes.append("several sliders match '%s' (%s) - name one in window_sliders" % (
                nm, ", ".join(s.NickName for s in cand)))
        else:
            notes.append("no slider found for '%s' - name it in window_sliders ('%s = <slider name>')" % (nm, nm))
    return out, notes


def _num(x):
    """float() of a number that may be a .NET System.Decimal (slider values are)."""
    try:
        return float(x)
    except TypeError:
        import System
        return System.Decimal.ToDouble(x)


def _slider_value(s, v):
    lo, hi = _num(s.Slider.Minimum), _num(s.Slider.Maximum)
    return round(min(hi, max(lo, float(v))), int(s.Slider.DecimalPlaces))


def _push_sliders(pairs):
    """Set slider values without triggering a solution per slider (call from a scheduled callback only)."""
    import System
    from Grasshopper.Kernel import GH_Document
    was = GH_Document.EnableSolutions
    GH_Document.EnableSolutions = False
    try:
        for s, v in pairs:
            s.SetSliderValue(System.Decimal(_slider_value(s, v)))
            s.ExpireSolution(False)
    finally:
        GH_Document.EnableSolutions = was


# ----------------------------------------------------------------------------- Rhino sun
def _set_rhino_sun(core, t, north_deg, la, lo, tzv, sky):
    import System
    import Rhino
    doc = Rhino.RhinoDoc.ActiveDoc
    sk = doc.RenderSettings.Skylight
    if sk.Enabled != bool(sky):
        sk.Enabled = bool(sky)
    sun = doc.Lights.Sun
    if not sun.Enabled:
        sun.Enabled = True
    if sun.ManualControlOn:
        sun.ManualControlOn = False
    for prop, val in (("Latitude", la), ("Longitude", lo), ("TimeZone", tzv),
                      ("North", core.rhino_north_deg(north_deg))):
        if abs(getattr(sun, prop) - val) > 1e-6:
            setattr(sun, prop, val)
    if sun.DaylightSavingOn:
        sun.DaylightSavingOn = False
    m, d, h = core.calendar_of(t)
    when = System.DateTime(2026, m, d, 0, 0, 0).AddSeconds(round(h * 3600.0))     # 2026: a non-leap year
    sun.SetDateTime(when, System.DateTimeKind.Local)
    sun = Rhino.RhinoDoc.ActiveDoc.Lights.Sun
    return sun.Altitude, sun.Azimuth


# ----------------------------------------------------------------------------- saved frames
_HTML = """<!doctype html>
<html><head><meta charset="utf-8"><meta name="viewport" content="width=device-width, initial-scale=1">
<title>Window time-lapse</title>
<style>
:root{--bg:#111;--fg:#eee;--mut:#999;--acc:#f2b84b}
body{margin:0;background:var(--bg);color:var(--fg);font:14px system-ui,sans-serif}
main{max-width:1400px;margin:0 auto;padding:16px}
img{width:100%%;height:auto;display:block;background:#000}
.bar{display:flex;flex-wrap:wrap;gap:12px;align-items:center;margin:10px 0}
button{background:var(--acc);border:0;border-radius:6px;padding:8px 16px;font-weight:600;cursor:pointer}
input[type=range]{flex:1;min-width:160px}
.m{color:var(--mut)}
</style></head><body><main>
<h1 style="font-size:18px;margin:0 0 8px">Window time-lapse <span class="m">%(note)s</span></h1>
<img id="f" alt="frame">
<div class="bar"><button id="p">Pause</button>
<label class="m">frame <span id="n"></span></label><input id="s" type="range" min="0" value="0">
<label class="m">speed <span id="v"></span> fps</label><input id="r" type="range" min="1" max="30" value="8" style="max-width:200px"></div>
<p class="m">Frames are PNG files in this folder; times are AEST (standard time).</p>
</main>
<script>
const F = %(frames)s;
let i = 0, playing = true, fps = 8, timer = null;
const img = document.getElementById('f'), s = document.getElementById('s'), n = document.getElementById('n');
s.max = Math.max(0, F.length - 1);
function show(k){ if(!F.length) return; i = (k + F.length) %% F.length; img.src = F[i]; s.value = i; n.textContent = (i+1) + ' / ' + F.length; }
function loop(){ clearInterval(timer); if(playing) timer = setInterval(() => show(i + 1), 1000 / fps); }
document.getElementById('p').onclick = e => { playing = !playing; e.target.textContent = playing ? 'Pause' : 'Play'; loop(); };
s.oninput = e => { show(+e.target.value); };
document.getElementById('r').oninput = e => { fps = +e.target.value; document.getElementById('v').textContent = fps; loop(); };
document.getElementById('v').textContent = fps; show(0); loop();
</script></body></html>
"""


def _write_player(folder, frames, note):
    with open(os.path.join(folder, "timelapse.html"), "w") as f:
        f.write(_HTML % {"frames": json.dumps(frames), "note": note})


def _capture(st):
    """Save the next frame - the perspective view as shown, or (render_frames) a full Rhino Render of it, which
    takes a few seconds and includes light bouncing round the room - with the date/time and pose written on it."""
    import System
    import Rhino
    from System.Drawing import Bitmap, Graphics, Font, FontStyle, SolidBrush, Color, RectangleF
    from System.Drawing.Imaging import ImageFormat
    doc = Rhino.RhinoDoc.ActiveDoc
    view = doc.Views.ActiveView
    if view is None or view.ActiveViewport.IsParallelProjection:       # a plan view is active: use a perspective one
        view = next((v for v in doc.Views.GetViewList(True, False) if not v.ActiveViewport.IsParallelProjection), view)
    name = "frame_%05d.png" % (st["frame"] + 1)
    path = os.path.join(st["frames_dir"], name)
    if st["cfg"]["render_frames"]:
        doc.Views.ActiveView = view
        Rhino.RhinoApp.RunScript("_-Render", False)
        Rhino.RhinoApp.RunScript('_-SaveRenderWindowAs "%s"' % path, False)
        Rhino.RhinoApp.RunScript("_-CloseRenderWindow", False)
        if not os.path.exists(path):
            raise RuntimeError("Rhino Render did not produce an image")
        img = Bitmap(path)
        bmp = Bitmap(img)                                       # a copy, so the file is not locked
        img.Dispose()
    else:
        vp = view.ActiveViewport
        cap = Rhino.Display.ViewCapture()
        cap.Width, cap.Height = vp.Size.Width, vp.Size.Height
        cap.ScaleScreenItems = False
        cap.DrawAxes = False
        cap.DrawGrid = False
        cap.DrawGridAxes = False
        bmp = cap.CaptureToBitmap(view)
    if bmp is None:
        return None
    g = Graphics.FromImage(bmp)
    font = Font("Segoe UI", 13.0, FontStyle.Bold)
    text = st.get("label", "")
    size = g.MeasureString(text, font)
    g.FillRectangle(SolidBrush(Color.FromArgb(150, 0, 0, 0)), RectangleF(8.0, 8.0, size.Width + 16.0, size.Height + 10.0))
    g.DrawString(text, font, SolidBrush(Color.White), 16.0, 13.0)
    g.Dispose()
    st["frame"] += 1
    bmp.Save(path, ImageFormat.Png)
    bmp.Dispose()
    st["frames"].append(name)
    _write_player(st["frames_dir"], st["frames"], st.get("note", ""))
    # frames.json: the exact moment and every window's (shown) setting of each frame - for editing / video
    st.setdefault("meta", []).append({"file": name, "t": st.get("t"), "label": st.get("label", ""),
                                      "windows": st.get("poses_now", [])})
    with open(os.path.join(st["frames_dir"], "frames.json"), "w") as f:
        json.dump(st["meta"], f)
    return name


# ----------------------------------------------------------------------------- the clock
def _schedule_tick(st, comp):
    """Ask Grasshopper for another solution in frame_ms; the callback saves the frame (if recording), moves the
    clock on, sets the sliders for the new moment and expires this component."""
    from Grasshopper.Kernel import GH_Document
    st["token"] += 1
    token = st["token"]
    core = st["core"]

    def tick(doc):
        if not st.get("playing") or st.get("token") != token:
            return                                               # stopped, or superseded by a newer tick
        cfg = st["cfg"]
        try:
            if cfg["save"] and st.get("frames_dir"):
                _capture(st)
        except Exception as e:                                   # never let a failed capture stop the clock
            st["capture_error"] = str(e)
        step_min = _frame_step_h(core, st, st["t"]) * 60.0
        st["t"] = core.advance_clock(st["t"], step_min, start=st["start"], skip_night=cfg["skip_night"],
                                     loop_day=cfg["loop_day"], lat=cfg["lat"], lon=cfg["lon"], tz=cfg["tz"])
        if cfg["drive"] and st.get("sliders"):
            w1 = st["sched"]["windows"][0]
            pose = _pose(core, w1, st["t"], cfg)[0]
            _push_sliders([(st["sliders"][nm], v) for nm, v in zip(w1["names"], pose) if nm in st["sliders"]])
        comp.ExpireSolution(False)

    st["tick"] = GH_Document.GH_ScheduleDelegate(tick)            # keep a reference: the delegate must outlive this run
    comp.OnPingDocument().ScheduleSolution(max(20, int(st["cfg"]["frame_ms"])), st["tick"])


def _schedule_slider_update(st, comp, pairs):
    from Grasshopper.Kernel import GH_Document

    def upd(doc):
        _push_sliders(pairs)

    st["upd"] = GH_Document.GH_ScheduleDelegate(upd)
    comp.OnPingDocument().ScheduleSolution(1, st["upd"])


def main():
    if core_dir and core_dir not in sys.path:
        sys.path.insert(0, core_dir)
    import importlib
    import window_beams_core as core
    importlib.reload(core)

    comp = _component()
    key = ("wbc_timelapse", str(comp.InstanceGuid) if comp is not None else "test")
    st = sc.sticky.setdefault(key, {"t": None, "start_key": None, "token": 0, "frame": 0, "frames": [],
                                    "frames_dir": None, "playing": False, "saving": False})
    st["core"] = core

    la, lo, tzv = float(_opt(lat, core.NEWCASTLE["lat"])), float(_opt(lon, core.NEWCASTLE["lon"])), \
        float(_opt(tz, core.NEWCASTLE["tz"]))
    cfg = {"step": float(_opt(step_minutes, 10.0)), "frame_ms": int(_opt(frame_ms, 200)),
           "skip_night": bool(_opt(skip_night, True)), "loop_day": bool(_opt(loop_day, False)),
           "smooth": bool(_opt(smooth, True)), "move_min": max(0.0, float(_opt(move_minutes, 1.0))),
           "slow_moves": bool(_opt(slow_moves, True)), "drive": bool(_opt(drive_window, True)),
           "save": bool(save_frames), "render_frames": bool(render_frames), "lat": la, "lon": lo, "tz": tzv}
    st["cfg"] = cfg

    scene = _cached("scene", scene_path, _read_json)
    rows = _cached("rows", csv_path, _read_rows)
    wins = core.split_windows(scene)
    n = len(wins)
    north = scene.get("north_deg", 0.0)

    # ---- every window's schedule at the scan's own time step (cached with the files: the scan's csv and its
    # poses_by_step.json, which break_up_moves.py may rewrite later), movement or regular test schedule
    fine = bool(_opt(fine_moves, True))
    pj = _poses_file(csv_path)
    skey = ("wbc_sched", csv_path, os.path.getmtime(csv_path),
            os.path.getmtime(pj) if os.path.exists(pj) else 0.0, n, fine)
    if skey not in sc.sticky:
        for k_ in [k_ for k_ in sc.sticky.keys() if isinstance(k_, tuple) and k_[:2] == skey[:2]]:
            del sc.sticky[k_]
        sc.sticky[skey] = _schedule(core, csv_path, rows, wins, fine)
    st["sched"] = sc.sticky[skey]

    # ---- start time: a changed date/time input restarts the clock there
    start = core.year_hours(_opt(month, 6), _opt(day, 21), _opt(hour, 9), _opt(minute, 0))
    start_key = (round(start, 6), la, lo, tzv)
    if st["start_key"] != start_key or st["t"] is None:
        st["t"], st["start_key"] = start, start_key
    st["start"] = start
    was_playing = st["playing"]
    st["playing"] = bool(play)
    if st["playing"] and not was_playing and cfg["skip_night"] and core.sun_at(st["t"], la, lo, tzv)[0] <= 0.0:
        st["t"] = core.next_daylight(st["t"], la, lo, tzv)
    t = st["t"]

    # ---- recording: a new folder each time save_frames is switched on
    if cfg["save"] and not st["saving"]:
        base = frames_dir or os.path.join(os.path.dirname(os.path.abspath(csv_path)), "timelapse")
        st["frames_dir"] = os.path.join(base, time.strftime("%Y-%m-%d_%H%M%S"))
        os.makedirs(st["frames_dir"])
        st["frame"], st["frames"], st["meta"] = 0, [], []
        st["note"] = "%s windows, from %s" % (n, core.time_label(start)) if n > 1 else "from " + core.time_label(start)
        _write_player(st["frames_dir"], [], st["note"])
    st["saving"] = cfg["save"]

    # ---- the moment
    alt, az = core.sun_at(t, la, lo, tzv)
    s = core.sun_vector(alt, az, north)
    hoy_i = int(t) % core.HOURS_PER_YEAR
    row = rows[hoy_i]
    label = core.time_label(t) + " AEST"
    rate = cfg["step"] * 1000.0 / max(20, cfg["frame_ms"])                 # simulated minutes per real second
    lines = ["%s   %s" % (label, "PLAYING  %g min per frame every %d ms  (about %s per second, more while rendering)" % (
        cfg["step"], cfg["frame_ms"], "%.1f simulated hours" % (rate / 60.0) if rate >= 60 else
        "%.1f simulated minutes" % rate)
        if st["playing"] else "paused (turn PLAY on to run the clock)"),
        "sun alt %.1f  az %.1f (%s)   DNI %s W/m2   outdoor %s C   indoor %s C   [hour row %d]" % (
            alt, az, core.compass_name(az), row.get("dni", "-"), row.get("temp", "-"),
            row.get("indoor_temp", "") or "-", hoy_i)]
    if alt <= 0:
        lines.append("sun is down" + (" - the clock skips to sunrise" if cfg["skip_night"] and st["playing"] else ""))
    sm = st["sched"]["step_min"]
    lines.append("schedule: every %s (%s)   motion: %s" % (
        "minute" if sm == 1 else ("hour" if sm == 60 else "%d min" % sm), st["sched"]["source"],
        "smooth moves, a full swing takes %g min%s" % (cfg["move_min"], ", slow motion during big moves"
                                                         if cfg["slow_moves"] else "")
        if cfg["smooth"] and cfg["move_min"] > 0 else "jumps to each new setting"))
    fb = st["sched"].get("fine")
    if fb:
        lines.append("playing the MOVEMENT schedule: fine transitions, one small move every %g s, each at most %g%% of "
                     "a full swing (fine_moves off = the regular test schedule)" % (fb["every_s"],
                                                                                   100.0 * fb["max_share"]))
    elif st["sched"].get("has_fine"):
        lines.append("playing the REGULAR test schedule (fine_moves on = the movement schedule with fine transitions)")

    wnames, pnames, pvals, tree, curves, poses = [], [], [], Grasshopper.DataTree[float](), [], []
    label_pose = []
    for k, w in enumerate(wins):
        pre = core.window_prefix(k, n)
        ws = st["sched"]["windows"][k]
        pn = ws["names"]
        pv, moving = _pose(core, ws, t, cfg)
        pose = dict(zip(pn, pv))
        wname = w.get("name") or "window %d" % (k + 1)
        wnames.append(wname)
        pnames += [pre + nm for nm in pn]
        pvals += pv
        for v in pv:
            tree.Add(v, GH_Path(k))
        poses.append({"name": wname, "pose": pose})
        if alt > 0:
            for plist in core.beam_polygons_3d(w, pose, alt, az).values():
                for poly in plist:
                    pl = rg.Polyline([rg.Point3d(*p) for p in poly])
                    pl.Add(pl[0])
                    curves.append(rg.PolylineCurve(pl))
        bw = row.get(pre + "beam_width_m", "")
        lines.append("%s%s%s   (this hour: beam score %s%s)" % (
            "" if n == 1 else "[%s] " % wname, "  ".join("%s %.2f" % (nm, v) for nm, v in pose.items()),
            "   MOVING (%.0f%% of a full swing)" % (moving * 100) if moving > 0 else "",
            row.get(pre + "beam_score", "-"),
            ", %.2f m wide on %s" % (float(bw), row.get(pre + "beam_target", "")) if bw not in ("", None) else ", no beam"))
        label_pose.append(("" if n == 1 else "W%d " % (k + 1)) + " ".join("%s %.1f" % (nm, v) for nm, v in pose.items()))
    st["label"] = "%s   sun alt %.0f az %.0f   %s" % (label, alt, az, "   ".join(label_pose))
    st["poses_now"] = poses

    # ---- Rhino sun
    if _opt(set_sun, True) and comp is not None:
        sky = bool(_opt(sky_light, False))
        ra, rz = _set_rhino_sun(core, t, north, la, lo, tzv, sky)
        lines.append("Rhino sun: Newcastle %.2f, %.2f, UTC%+g, north %.0f deg -> alt %.1f az %.1f (scan's sun: %.1f / %.1f)"
                     "   sky light %s" % (la, lo, tzv, core.rhino_north_deg(north), ra, rz, alt, az,
                                          "on" if sky else "off (sun only)"))

    # ---- your sliders (window 1)
    st["sliders"] = {}
    if cfg["drive"] and comp is not None:
        w1 = st["sched"]["windows"][0]
        smap, notes = _slider_map(w1["names"], window_sliders)
        st["sliders"] = smap
        lines += notes
        pairs = [(smap[nm], v) for nm, v in zip(w1["names"], _pose(core, w1, t, cfg)[0]) if nm in smap]
        if any(abs(_num(s_.Slider.Value) - _slider_value(s_, v)) > 1e-9 for s_, v in pairs):
            _schedule_slider_update(st, comp, pairs)
        if smap:
            lines.append("driving sliders: " + ", ".join("%s -> '%s'" % (nm, s_.NickName) for nm, s_ in smap.items()))

    if st.get("frames_dir") and cfg["save"]:
        lines.append("recording: %d frame(s) in %s  (open timelapse.html to play)" % (st["frame"], st["frames_dir"]))
    if st.get("capture_error"):
        lines.append("last frame capture failed: " + st.pop("capture_error"))

    # ---- keep going
    if st["playing"] and comp is not None:
        _schedule_tick(st, comp)

    pj = json.dumps({"t": t, "label": label, "sun": [alt, az], "windows": poses})
    return ("\n".join(lines), label, t, hoy_i, rg.Vector3d(*s), alt, az, wnames, pnames, pvals, tree, pj, curves,
            st.get("frames_dir") or "")


(info, time_text, t_hours, hoy, sun_vec, sun_alt, sun_az, window_names, param_names, pose_values, pose_tree,
 poses_json, beam_curves, frames_folder) = main()
# ---------- end _5_time_lapse_clock ----------
_6_render_sync = Python3Script(
    core_dir=code_folder,
    scene_path=scene_resolved_json,
    on=copy_building_window_into_rhino_for_the,
    poses_json=_5_time_lapse_clock.poses_json,
    housing=_0_window_size.sized_housing,
    ring1=_0_window_size.sized_ring1,
    ring2=_0_window_size.sized_ring2,
    ring3=_0_window_size.sized_ring3,
    blade_top=_0_window_size.sized_blade_top,
    blade_bottom=_0_window_size.sized_blade_bottom,
    room=_0_window_size.sized_room,
    context=building_context_shading_geometry_that_c,
    use_context=shading_context_on_turn_off_if_nothing_s,
    beam_curves=_5_time_lapse_clock.beam_curves,
    show_beam_outline=show_predicted_beam_outline,
    clean_view=clean_view_hide_grasshopper_previews,
    view_mode=display_mode_rendered_raytraced_empty_le,
    set_view=go_to_the_time_lapse_camera_view,
    axis_ring1=_0_window_size.sized_axis_ring1,
    axis_ring2=_0_window_size.sized_axis_ring2,
    axis_ring3=_0_window_size.sized_axis_ring3,
    axis_blade_top=_0_window_size.sized_axis_blade_top,
    axis_blade_bottom=_0_window_size.sized_axis_blade_bottom)  # -> out, info; inputs housing: list of Brep, ring1: list of Brep, ring2: list of Brep, ring3: list of Brep, blade_top: list of Brep, blade_bottom: list of Brep, room: list of GeometryBase, context: list of GeometryBase, beam_curves: list of Curve, axis_ring1: list of Curve, axis_ring2: list of Curve, axis_ring3: list of Curve, axis_blade_top: list of Curve, axis_blade_bottom: list of Curve
# ---------- _6_render_sync: Python ----------
# -*- coding: utf-8 -*-
"""
gh_06_render_sync.py   -   Grasshopper "Python 3 Script" component (Rhino 8)   "6 RENDER SYNC"
================================================================================
Rhino's lighting (Rendered and Raytraced views, the Render command) only lights objects that are in the Rhino
document - and your building and window live inside Grasshopper.  This keeps a copy of them on Rhino layers,
moved to the clock's moment:

  Window time-lapse::room             your room + shading context (copied once; again when they change)
  Window time-lapse::window           every window: housing fixed, rings + blades moved to the pose (every frame)
  Window time-lapse::predicted beam   the scan's predicted beam outlines (when show_beam_outline is on)

The window is moved with the same hinge kinematics the scan scored, so the picture is the scan's result.
Windows added with the 'windows' planes are copied too.  Delete the 'Window time-lapse' layer to remove it all.

INPUTS
  core_dir     [str]       folder containing window_beams_core.py
  scene_path   [str]       scene_resolved.json written by the scan
  on           [bool]      keep the Rhino copy up to date
  poses_json   [str]       from 5 TIME-LAPSE CLOCK
  housing, ring1, ring2, ring3, blade_top, blade_bottom  [Brep, list]  the window as modelled (sliders at 0)
  axis_ring1, axis_ring2, axis_ring3, axis_blade_top, axis_blade_bottom  [Curve]  OPTIONAL the hinge axes as they
                           are now (from 0 WINDOW SIZE): the parts then swing about these, so a resized window
                           moves correctly even before it has been re-scanned
  room         [Geometry, list]  room Breps / meshes (curves and points are ignored)
  context      [Geometry, list]  shading context (optional);  use_context [bool]
  beam_curves  [Curve, list]     from the clock;  show_beam_outline [bool]
  clean_view   [bool]      hide Grasshopper's own previews while on, so only the lit Rhino copy shows (default True)
  view_mode    [str]       'Rendered' / 'Raytraced' / '' (leave the view alone) - applied when it changes
  set_view     [bool]      when switched on: go to the named view 'Window time-lapse' (made from the room the
                           first time; move the camera and update the named view to keep your own)
OUTPUTS
  info         [str]
"""
import sys
import os
import json
import hashlib

import Rhino
import Rhino.Geometry as rg
import scriptcontext as sc

AXIS_JOINTS = (("axis_ring1", "j1"), ("axis_ring2", "j2"), ("axis_ring3", "j3"), ("axis_blade_top", "jt"),
               ("axis_blade_bottom", "jb"))
for _n in ("core_dir", "scene_path", "on", "poses_json", "housing", "ring1", "ring2", "ring3", "blade_top",
           "blade_bottom", "room", "context", "use_context", "beam_curves", "show_beam_outline", "clean_view",
           "view_mode", "set_view") + tuple(a for a, _ in AXIS_JOINTS):
    globals().setdefault(_n, None)

ROOT = "Window time-lapse"
TAG = "wbc_timelapse"
VIEW_NAME = "Window time-lapse"
BODY_INPUTS = ("housing", "ring1", "ring2", "ring3", "blade_top", "blade_bottom")


def _opt(v, default):
    return default if v is None else v


def _component():
    try:
        return ghenv.Component                                   # noqa: F821
    except NameError:
        return None


def _list(v):
    if v is None:
        return []
    return [x for x in (v if isinstance(v, (list, tuple)) else [v]) if x is not None]


def _geo(doc, g):
    """RhinoCommon geometry from whatever arrives: geometry, Grasshopper goo (GH_Brep ...) or the Guid of a
    referenced Rhino object."""
    import System
    if isinstance(g, rg.GeometryBase):
        return g
    v = getattr(g, "Value", None)
    if isinstance(v, rg.GeometryBase):
        return v
    gid = g if isinstance(g, System.Guid) else (v if isinstance(v, System.Guid) else None)
    if gid is not None:
        o = doc.Objects.FindId(gid)
        return o.Geometry if o is not None else None
    return None


def _renderable(g):
    return isinstance(g, (rg.Brep, rg.Mesh, rg.Extrusion, rg.SubD, rg.Surface))


def _sig(geoms):
    h = hashlib.md5()
    for g in geoms:
        b = g.GetBoundingBox(True)
        h.update(("%s|%.4f,%.4f,%.4f|%.4f,%.4f,%.4f;" % (type(g).__name__, b.Min.X, b.Min.Y, b.Min.Z,
                                                          b.Max.X, b.Max.Y, b.Max.Z)).encode())
    return h.hexdigest()


def _follow_axes(doc, win):
    """Put window 1's hinge origins on the hinge axes wired in now (the scan's scene may be from before a resize:
    the axes only ever move sideways to themselves, so the closest point on the new line is the new origin).
    Returns the largest move in metres (model units)."""
    joints = dict((j["name"], j) for j in win.get("joints", []))
    worst = 0.0
    for inp, jn in AXIS_JOINTS:
        crvs = [c for c in (_geo(doc, x) for x in _list(globals().get(inp))) if isinstance(c, rg.Curve)]
        if not crvs or jn not in joints:
            continue
        line = rg.Line(crvs[0].PointAtStart, crvs[0].PointAtEnd)
        o = rg.Point3d(*joints[jn]["origin"])
        p = line.ClosestPoint(o, False)
        d = p.DistanceTo(o)
        if d > 1e-6:
            joints[jn]["origin"] = [p.X, p.Y, p.Z]
            worst = max(worst, d)
    return worst


def _xform(M):
    T = rg.Transform(1.0)
    for r in range(3):
        for c in range(4):
            setattr(T, "M%d%d" % (r, c), float(M[r][c]))
    return T


# ----------------------------------------------------------------------------- layers + materials
def _layer(doc, name, color, parent=None, shade=None):
    import System.Drawing as sd
    full = name if parent is None else "%s::%s" % (ROOT, name)
    idx = doc.Layers.FindByFullPath(full, -1)
    if idx < 0:
        lay = Rhino.DocObjects.Layer()
        lay.Name = name
        lay.Color = sd.Color.FromArgb(*color)
        if parent is not None:
            lay.ParentLayerId = doc.Layers[parent].Id
        idx = doc.Layers.Add(lay)
        if shade is not None:
            mat = Rhino.DocObjects.Material()
            mat.Name = "Window time-lapse %s" % name
            mat.DiffuseColor = sd.Color.FromArgb(*shade)
            mat.Shine = 0.0
            mat.Reflectivity = 0.0
            mi = doc.Materials.Add(mat)
            lay = doc.Layers[idx]
            lay.RenderMaterialIndex = mi
            doc.Layers.Modify(lay, idx, True)
    return idx


def _index(doc, layers):
    """{tag value: Guid} of the objects this component made (found again after a reload)."""
    out = {}
    for li in layers:
        for o in doc.Objects.FindByLayer(doc.Layers[li]) or []:
            v = o.Attributes.GetUserString(TAG)
            if v:
                out[v] = o.Id
    return out


def _put(doc, ids, key, geom, layer):
    """Replace the object tagged ``key`` with ``geom`` (same Guid), or add it."""
    gid = ids.get(key)
    if gid is not None and doc.Objects.FindId(gid) is not None:
        if doc.Objects.Replace(gid, geom):
            return gid
        doc.Objects.Delete(gid, True)
    attr = Rhino.DocObjects.ObjectAttributes()
    attr.LayerIndex = layer
    attr.SetUserString(TAG, key)
    gid = doc.Objects.Add(geom, attr)
    if gid == type(gid).Empty and isinstance(geom, rg.Brep):      # Rhino refused an invalid Brep: repair / mesh it
        fixed = geom.DuplicateBrep()
        if fixed.Repair(doc.ModelAbsoluteTolerance) and fixed.IsValid:
            gid = doc.Objects.Add(fixed, attr)
        if gid == type(gid).Empty:
            meshes = rg.Mesh.CreateFromBrep(geom, rg.MeshingParameters.QualityRenderMesh) or []
            m = rg.Mesh()
            for x in meshes:
                m.Append(x)
            if m.Vertices.Count:
                m.Normals.ComputeNormals()
                m.Compact()
                gid = doc.Objects.Add(m, attr)
    if gid == type(gid).Empty:                                    # still refused
        return None
    ids[key] = gid
    return gid


def _drop(doc, ids, keep_prefix_pred):
    for key in [k for k in ids if keep_prefix_pred(k)]:
        doc.Objects.Delete(ids.pop(key), True)


# ----------------------------------------------------------------------------- view
def _camera(core, scene):
    """A camera in the back of the room, high and centred on window 1, looking down at the window wall and the
    floor in front of it - where the beams sweep through the day."""
    w1 = core.split_windows(scene)[0]
    ext = core.vunit(tuple(w1["exterior_dir"]))
    into = (-ext[0], -ext[1], 0.0)
    into = core.vunit(into) if core.vlen(into) > 1e-9 else (0.0, 1.0, 0.0)      # skylight: look along +Y
    exitp = tuple(w1["exit_point"])
    pts = [p for v in core.targets_outline_3d(scene).values() for p in v]
    if not pts:
        pts = [exitp]
    depth = max(2.0, max(core.vdot(core.vsub(p, exitp), into) for p in pts))
    floor = min(p[2] for p in pts)
    cam = core.vadd(exitp, core.vscale(into, 0.72 * depth))
    tgt = core.vadd(exitp, core.vscale(into, 0.22 * depth))
    cam = (cam[0], cam[1], floor + 2.6)
    tgt = (tgt[0], tgt[1], floor)
    return rg.Point3d(*cam), rg.Point3d(*tgt)


def _perspective_view(doc):
    """The view the time-lapse uses: the active view if it is a perspective one, else the first perspective
    view (made active, so saved frames capture it).  Plan / elevation views are never changed."""
    v = doc.Views.ActiveView
    if v is None or v.ActiveViewport.IsParallelProjection:
        for cand in doc.Views.GetViewList(True, False):
            if not cand.ActiveViewport.IsParallelProjection:
                doc.Views.ActiveView = cand
                return cand
    return v


def _go_to_view(core, doc, scene):
    view = _perspective_view(doc)
    vp = view.ActiveViewport
    i = doc.NamedViews.FindByName(VIEW_NAME)
    if i >= 0:
        try:
            doc.NamedViews.Restore(i, vp)
        except Exception:
            doc.NamedViews.Restore(i, view, False)
        view.Redraw()
        return "restored the named view '%s'" % VIEW_NAME
    if doc.NamedViews.FindByName(VIEW_NAME + " - your view before") < 0:      # keep the camera it replaces
        doc.NamedViews.Add(VIEW_NAME + " - your view before", vp.Id)
    cam, tgt = _camera(core, scene)
    if vp.IsParallelProjection:
        vp.ChangeToPerspectiveProjection(True, 20.0)
    vp.SetCameraLocations(tgt, cam)
    vp.Camera35mmLensLength = 18.0
    doc.NamedViews.Add(VIEW_NAME, vp.Id)
    return ("made the named view '%s' inside the room (move the camera, then update the named view to keep yours;"
            " your previous camera is the named view '%s - your view before')" % (VIEW_NAME, VIEW_NAME))


def _set_mode(doc, name):
    view = _perspective_view(doc)
    for m in Rhino.Display.DisplayModeDescription.GetDisplayModes():
        if m.EnglishName.lower() == name.lower():
            view.ActiveViewport.DisplayMode = m
            return "%s view in %s mode" % (view.ActiveViewport.Name, m.EnglishName)
    return "no display mode called '%s'" % name


# ----------------------------------------------------------------------------- main
def main():
    lines = []
    comp = _component()
    on_ = bool(_opt(on, True))
    key = ("wbc_render_sync", str(comp.InstanceGuid) if comp is not None else "test")
    st = sc.sticky.setdefault(key, {"static_sig": None, "pose_sig": None, "beam_sig": None, "set_view": False,
                                    "mode": None, "prev_preview": None})

    # ---- Grasshopper's own previews (they would draw over the lit copy)
    if comp is not None:
        from Grasshopper.Kernel import GH_PreviewMode
        ghdoc = comp.OnPingDocument()
        want_clean = bool(_opt(clean_view, True)) and on_
        if want_clean:
            if ghdoc.PreviewMode != GH_PreviewMode.Disabled:
                st["prev_preview"] = ghdoc.PreviewMode
                ghdoc.PreviewMode = GH_PreviewMode.Disabled
            lines.append("Grasshopper previews hidden (clean_view) - turn clean_view off to see them again")
        elif st.get("clean"):                                     # switched off: bring the previews back
            ghdoc.PreviewMode = st.get("prev_preview") or GH_PreviewMode.Shaded
            st["prev_preview"] = None
        st["clean"] = want_clean
    if not on_:
        return "off - the Rhino copy is left as it is (delete the '%s' layer to remove it)" % ROOT

    if core_dir and core_dir not in sys.path:
        sys.path.insert(0, core_dir)
    import importlib
    import window_beams_core as core
    importlib.reload(core)

    doc = Rhino.RhinoDoc.ActiveDoc
    with open(scene_path) as f:
        scene = json.load(f)
    wins = core.split_windows(scene)
    shift = _follow_axes(doc, wins[0])
    if shift > 0.005:
        lines.append("hinges follow the window as it is now (moved up to %.2f m since the scan - BUILD and RUN "
                     "to re-scan the new size)" % shift)
    state = json.loads(poses_json) if poses_json else {"windows": []}
    poses = dict((w["name"], w["pose"]) for w in state.get("windows", []))

    bodies = {}
    for nm in BODY_INPUTS:
        bodies[nm] = [g for g in (_geo(doc, x) for x in _list(globals().get(nm))) if g is not None]
    missing = [nm for nm in BODY_INPUTS if not bodies[nm]]
    if missing:
        lines.append("no geometry on: %s (those parts are not shown)" % ", ".join(missing))

    root = _layer(doc, ROOT, (90, 90, 90))
    l_room = _layer(doc, "room", (150, 150, 150), root, shade=(205, 203, 198))
    l_win = _layer(doc, "window", (60, 60, 70), root, shade=(48, 48, 52))
    l_beam = _layer(doc, "predicted beam", (255, 150, 0), root)
    ids = st.get("ids")
    if ids is None or any(doc.Objects.FindId(g) is None for g in ids.values()):
        ids = _index(doc, (l_room, l_win, l_beam))
        st["static_sig"] = st["pose_sig"] = st["beam_sig"] = None     # something was deleted: rebuild the copy
    st["ids"] = ids

    undo = doc.UndoRecordingEnabled
    doc.UndoRecordingEnabled = False
    try:
        # ---- static: room + context + housings
        static = [g for g in (_geo(doc, x) for x in _list(room)) if g is not None and _renderable(g)]
        if _opt(use_context, True):
            static += [g for g in (_geo(doc, x) for x in _list(context)) if g is not None and _renderable(g)]
        uniq, seen = [], set()
        for g in static:                                          # the same Brep wired in twice -> once
            s_ = _sig([g])
            if s_ not in seen:
                seen.add(s_)
                uniq.append(g)
        static = uniq
        homes = []                                                # (key, geometry) of each window's housing
        for k, w in enumerate(wins):
            M = core.window_body_matrices(wins[0], w, dict((n, 0.0) for n in core.Mechanism(w).param_names))["housing"]
            for i, g in enumerate(bodies["housing"]):
                d = g.Duplicate()
                if k:
                    d.Transform(_xform(M))
                homes.append(("housing:w%d:%d" % (k + 1, i), d))
        ssig = _sig(static + [g for _, g in homes])
        if ssig != st["static_sig"]:
            _drop(doc, ids, lambda k_: k_.startswith("room:") or k_.startswith("housing:"))
            bad = 0
            for i, g in enumerate(static):
                bad += _put(doc, ids, "room:%d" % i, g.Duplicate(), l_room) is None
            for k_, g in homes:
                bad += _put(doc, ids, k_, g, l_win) is None
            st["static_sig"] = ssig
            st["static_note"] = "copied %d room/context object(s) and %d housing(s) to layer '%s'%s" % (
                len(static) - bad, len(homes), ROOT,
                "; %d object(s) Rhino rejected as invalid geometry (left out)" % bad if bad else "")
        lines.append(st.get("static_note", ""))
        # ---- moving parts
        psig = json.dumps([poses.get(w.get("name") or "window %d" % (k + 1)) for k, w in enumerate(wins)],
                          sort_keys=True) + _sig([g for nm in BODY_INPUTS[1:] for g in bodies[nm]]) + \
            json.dumps([j["origin"] for j in wins[0].get("joints", [])])
        if psig != st["pose_sig"]:
            used = set()
            for k, w in enumerate(wins):
                wname = w.get("name") or "window %d" % (k + 1)
                pose = poses.get(wname)
                if pose is None:
                    continue
                mats = core.window_body_matrices(wins[0], w, pose)
                for nm in BODY_INPUTS[1:]:
                    T = _xform(mats[nm])
                    for i, g in enumerate(bodies[nm]):
                        d = g.Duplicate()
                        d.Transform(T)
                        kk = "%s:w%d:%d" % (nm, k + 1, i)
                        _put(doc, ids, kk, d, l_win)
                        used.add(kk)
            _drop(doc, ids, lambda k_: k_.split(":")[0] in BODY_INPUTS[1:] and k_ not in used)
            st["pose_sig"] = psig
        lines.append("window: %d window(s) moved to %s" % (len(wins), state.get("label", "?")))
        # ---- predicted beam outlines
        curves = [c for c in (_geo(doc, x) for x in _list(beam_curves)) if isinstance(c, rg.Curve)] \
            if show_beam_outline else []
        bsig = _sig(curves)
        if bsig != st["beam_sig"]:
            _drop(doc, ids, lambda k_: k_.startswith("beam:"))
            for i, c in enumerate(curves):
                _put(doc, ids, "beam:%d" % i, c.DuplicateCurve(), l_beam)
            st["beam_sig"] = bsig
        if show_beam_outline:
            lines.append("predicted beam outline: %d curve(s) on layer 'predicted beam'" % len(curves))
    finally:
        doc.UndoRecordingEnabled = undo

    # ---- view
    if set_view and not st["set_view"]:
        lines.append(_go_to_view(core, doc, scene))
        st["mode"] = None                                         # re-apply the display mode too
    st["set_view"] = bool(set_view)
    if view_mode and view_mode.strip() and view_mode.strip() != st["mode"]:
        lines.append(_set_mode(doc, view_mode.strip()))
        st["mode"] = view_mode.strip()
    doc.Views.Redraw()
    return "\n".join(lines)


info = main()
# ---------- end _6_render_sync ----------
time_lapse_info = Panel(_5_time_lapse_clock.info)
render_sync_info = Panel(_6_render_sync.info)

# ---- group: LIGHT TARGET (lab preview) (continued)
l_light_target = Python3Script(
    beam_w=beam_width_m,
    depth_m=light_target_depth_into_the_room_m_0_off,
    offset_m=light_target_offset_right_looking_out_m,
    height_m=light_target_height_above_floor_m,
    radius_m=light_target_reach_radius_m,
    mode=light_target_mode_0_off_1_reach_preview,
    t_hours=_5_time_lapse_clock.t_hours)  # -> out, T, path, reach, times, dist, patch, summary, overrides
# ---------- l_light_target: Python ----------
# --- canvas adapter (TESTER, T-004): day / minute from the time-lapse clock's t_hours output.  The rest below
# is lab\models\gh_light_target.py (MODELER, M-005) as it was when added - re-run lab\tools\add_light_target.py
# to reload it.
try:
    if t_hours is not None:
        day = int(float(t_hours) // 24)
        minute = int(round((float(t_hours) % 24) * 60)) % 1440
except NameError:
    pass
# -*- coding: utf-8 -*-
"""
gh_light_target.py - Grasshopper (Rhino 8, Python 3 script component) for the LIGHT TARGET slider and its two modes.
NOT on the canvas yet: the TESTER adds it (only the TESTER drives Rhino).  No physics runs here: it reads the reach
table that target_mode.py precomputed from the G1 plan (lab\\out\\reach_w<tag>.json), so it is instant.

Inputs (all optional except table_dir):
  table_dir   folder with reach_w005.json ... (lab\\out)
  beam_w      Felix's beam width (m) - READ only, picks the table (0.05 -> reach_w005.json)
  depth_m     target distance into the room from the window (slider 0-8 m; 0 = target off)
  offset_m    target offset to the RIGHT looking out of the window (slider -4..4 m)
  height_m    target height above the floor (0 = floor, 0.75 = desk)
  radius_m    "reached" when the beam's lit patch comes within this distance (default 0.5)
  mode        0 = off, 1 = reach preview, 2 = target-only (spotlight) - integer slider or value list
  day         day of year, 0-based (from the time-lapse clock), or text "4/8" = 8 April
  minute      minute of the day now (from the clock), for the current patch
Outputs:
  T           target point
  path        landing points (light centroid) of the clean beam through the day, every 5 min
  reach       True / False per path point (patch within radius_m of T)
  times       "HH:MM" per path point
  dist        distance (m) per path point
  patch       outline(s) of the lit patch at the current minute (closed polylines)
  summary     e.g. "target reached 10:05-13:50 (225 min); nearest 0.12 m at 11:40"
  overrides   JSON for the scan component (integration phase): light_target + target_mode
"""
import json
import os
import sys

LAB_MODELS = r"C:\Users\felix\Documents\WindowOptimizer\lab\models"
if LAB_MODELS not in sys.path:
    sys.path.insert(0, LAB_MODELS)
import reach_core as RC  # noqa: E402

try:
    import Rhino.Geometry as rg
    import scriptcontext as sc
    STICKY = sc.sticky
except ImportError:                                  # outside Rhino (lab test)
    rg = None
    STICKY = {}

MONTH_START = [0, 31, 59, 90, 120, 151, 181, 212, 243, 273, 304, 334]


def _g(name, default):
    v = globals().get(name)
    return default if v is None else v


def _pt(p):
    return rg.Point3d(p[0], p[1], p[2]) if rg else tuple(p)


def _table(table_dir, beam_w):
    tag = "%03d" % int(round(float(beam_w) * 100))
    path = os.path.join(table_dir, "reach_w%s.json" % tag)
    key = ("reach_table", path, os.path.getmtime(path) if os.path.exists(path) else 0)
    if key not in STICKY:
        for k in [k for k in STICKY if isinstance(k, tuple) and k and k[0] == "reach_table"]:
            del STICKY[k]                           # keep one table in memory
        tbl = RC.load_table(path)
        byday = {}
        for row in tbl["rows"]:
            byday.setdefault(row[0] // 1440, []).append(row)
        tbl["byday"] = byday
        STICKY[key] = tbl
    return STICKY[key]


def solve(table_dir, beam_w, depth_m, offset_m, height_m, radius_m, mode, day, minute):
    out = {"T": None, "path": [], "reach": [], "times": [], "dist": [], "patch": [], "summary": "target off",
           "overrides": json.dumps({"light_target": None, "target_mode": "off"})}
    if not mode or depth_m is None or float(depth_m) <= 0:
        return out
    if isinstance(day, str) and "/" in day:                     # "4/8" = 8 April
        m, d = [int(x) for x in day.split("/")]
        day = MONTH_START[m - 1] + d - 1
    day = int(day)
    tbl = _table(table_dir, beam_w)
    T = RC.target_point(tbl, float(depth_m), float(offset_m or 0.0), float(height_m or 0.0))
    sub = {"rows": tbl["byday"].get(day, [])}
    sub.update(dict((k, tbl[k]) for k in ("m_per_unit", "exit", "r", "w", "u", "floor_u")))
    path = RC.day_path(sub, day, T, float(radius_m or 0.5))
    out["T"] = _pt(T)
    out["path"] = [_pt(p["landing"]) for p in path]
    out["reach"] = [p["reach"] for p in path]
    out["times"] = [p["time"] for p in path]
    out["dist"] = [p["d_m"] for p in path]
    out["summary"] = RC.summary(path, tbl.get("step_min", 5))
    if minute is not None:
        s0 = day * 1440 + int(minute) // 5 * 5
        for row in sub["rows"]:
            if row[0] == s0:
                for poly in row[3]:
                    pts = [_pt(q) for q in poly] + [_pt(poly[0])]
                    out["patch"].append(rg.PolylineCurve(pts) if rg else pts)
    out["overrides"] = json.dumps({
        "light_target": {"depth_m": float(depth_m), "offset_m": float(offset_m or 0.0),
                         "height_m": float(height_m or 0.0), "strength": 1.0, "point_xyz": list(T)},
        "target_mode": {1: "preview", 2: "spotlight"}.get(int(mode), "off"),
        "target_radius_m": float(radius_m or 0.5)})
    return out


_res = solve(_g("table_dir", os.path.join(os.path.dirname(LAB_MODELS), "out")), _g("beam_w", 0.05),
             _g("depth_m", 0.0), _g("offset_m", 0.0), _g("height_m", 0.0), _g("radius_m", 0.5), _g("mode", 0),
             _g("day", 0), _g("minute", None))
T, path, reach, times, dist, patch, summary, overrides = (_res[k] for k in ("T", "path", "reach", "times", "dist",
                                                                            "patch", "summary", "overrides"))
# ---------- end l_light_target ----------
light_target_summary = Panel(l_light_target.summary)

# ---- group: Beam optimiser (continued)
_1_build_scene = Python3Script(
    core_dir=code_folder,
    build=build_scene_turn_off_after,
    housing=_0_window_size.sized_housing,
    ring1=_0_window_size.sized_ring1,
    ring2=_0_window_size.sized_ring2,
    ring3=_0_window_size.sized_ring3,
    blade_top=_0_window_size.sized_blade_top,
    blade_bottom=_0_window_size.sized_blade_bottom,
    axis_ring1=_0_window_size.sized_axis_ring1,
    axis_ring2=_0_window_size.sized_axis_ring2,
    axis_ring3=_0_window_size.sized_axis_ring3,
    axis_blade_top=_0_window_size.sized_axis_blade_top,
    axis_blade_bottom=_0_window_size.sized_axis_blade_bottom,
    grid=pose_grid_name_min_max_count,
    exterior_dir=exterior_direction_leave_empty_automatic,
    facing_deg=facing_deg_0_n_90_e_180_s_270_w,
    scene_path=scene_json,
    context=building_context_shading_geometry_that_c,
    use_context=shading_context_on_turn_off_if_nothing_s,
    room=_0_window_size.sized_room,
    windows=additional_windows_one_plane_each_origin,
    glazing=glazing_windows_glazed_doors_roof_lights,
    energy_walls=external_walls_above_ground,
    energy_walls_earth=walls_below_ground_retaining,
    energy_common_walls=common_walls_shared_with_a_neighbour_no,
    energy_roof=roof_ceiling,
    energy_floor_slab=floor_slab_on_ground,
    energy_floor_suspended=floor_suspended_subfloor_space,
    energy_doors=doors_opaque)  # -> out, scene_file, report, mouth_curves, blocker_pts, target_curves; inputs housing: Brep, ring1: Brep, ring2: Brep, ring3: Brep, blade_top: Brep, blade_bottom: Brep, axis_ring1: Curve, axis_ring2: Curve, axis_ring3: Curve, axis_blade_top: Curve, axis_blade_bottom: Curve, exterior_dir: Vector3d, context: list of GeometryBase, room: list of GeometryBase, windows: list of Plane, glazing: list of GeometryBase, energy_walls: list of GeometryBase, energy_walls_earth: list of GeometryBase, energy_common_walls: list of GeometryBase, energy_roof: list of GeometryBase, energy_floor_slab: list of GeometryBase, energy_floor_suspended: list of GeometryBase, energy_doors: list of GeometryBase
# ---------- _1_build_scene: Python ----------
# -*- coding: utf-8 -*-
"""
gh_01_build_scene.py   -   Grasshopper "Python 3 Script" component (Rhino 8)
================================================================================
Reads YOUR window geometry + room surfaces from Rhino/Grasshopper and writes the
`scene.json` that window_beams_core.py works from.

Create a Python 3 Script component, paste this file in, then add these parameters
(right-click the input/output name -> set the Type hint shown in brackets):

INPUTS
  core_dir         [str]      folder that contains window_beams_core.py
  build            [bool]     toggle - runs when True
  housing          [Brep]     fixed frame/housing solid (the part that stays in the wall)
  ring1            [Brep]     outermost moving tube section
  ring2            [Brep]
  ring3            [Brep]     innermost / last tube section
  blade_top        [Brep]     the two plates that close in from the top and bottom
  blade_bottom     [Brep]
  axis_ring1       [Curve]    the axis curves of your RotAx components (straight).  For the rings the direction
  axis_ring2       [Curve]    is checked: a positive Ring Angle must tilt the tube UP, and an axis drawn the
  axis_ring3       [Curve]    other way is reversed (the build report says so).  Blades: see top_gain.
  axis_blade_top   [Curve]
  axis_blade_bottom[Curve]
  top_gain         [float]    OPTIONAL deg per unit of "Aperture Close" for the top blade.  LEAVE EMPTY: the
  bottom_gain      [float]    blades then CLOSE toward the centre of the opening as Aperture Close goes 0 -> 100:
                              top blade 35 deg (down), bottom blade 30 deg (up) - the turning direction is worked
                              out from the geometry and the axis curves (your expressions: top -x*35/100, bottom
                              x*30/100).  A value given here is used as it is; the build report warns if it would
                              swing a blade outward.
  grid             [str]      pose grid, e.g.  "ring=0:15:11 aperture=0:100:11"
                              (name=min:max:count).  Use ring1= ring2= ring3= for independent rings.
  exterior_dir     [Vector3d] OPTIONAL - leave EMPTY and it is worked out from the window geometry (the
                              tube chain sticks out of the housing toward the outside; within 3 deg of a
                              model axis it snaps to the axis). Give a vector only to override it.
  windows          [Plane]    OPTIONAL list: MORE windows. Each plane puts one more copy of the window you wired in
                              at that position, facing the plane's Z axis (origin = centre of that window's inner
                              opening; the window stays upright, X/Y of the plane are ignored). All windows share
                              the one room and are optimised together. A plain point also works (same facing as
                              the first window). Empty = just the window you wired in.
  room             [GeometryBase] OPTIONAL ONE list for the whole room: Breps = room faces (floor, walls,
                              ceiling; each planar and convex), curves = hero zones (closed curves on those
                              faces where you want beams), a point = any spot inside the room (optional - the
                              centre of the faces is used if you leave it out). Empty = placeholder room.
                              (targets / hero_zones / room_point still work as separate inputs.)
  glazing          [GeometryBase] OPTIONAL list: the building's OTHER glazing - windows, glazed doors, roof lights
                              (surfaces or thin glass solids).  Only their areas and the way they face are used, for
                              the energy model (NCC 2022 terms: glazing = glass + frame; 0-70 deg from horizontal =
                              roof light, steeper = window).  The articulating window is counted on its own.
  energy_walls, energy_walls_earth, energy_common_walls, energy_roof, energy_floor_slab, energy_floor_suspended,
  energy_doors     [GeometryBase] OPTIONAL lists - YOU say what is what for the energy model: external walls above
                              ground; walls below ground; common walls (shared with a neighbour: no heat flow);
                              roof / ceiling; slab-on-ground; suspended floor; opaque doors.  Surfaces count once,
                              solids by their side facing the room.  A window or glazing piece sitting inside an uncut
                              wall face is taken out of that wall; a wall with the opening cut out is used as it is.
                              Any input left empty is worked out from the room faces (as before).
  use_context      [bool]     OPTIONAL toggle: False = nothing shades the window (the context is ignored).
                              Empty counts as True.
  context          [GeometryBase] OPTIONAL list: the building, neighbours, overhangs, trees - anything that
                              can SHADE the window (Breps, Meshes, Extrusions). Keep it light (<20000
                              triangles); cut the window's own opening out of the wall if you include it.
  facing_deg       [float]    OPTIONAL compass bearing the window faces (0 N, 90 E, 180 S, 270 W).
                              Sets north for you. It can be changed later in gh_02 / gh_04, so
                              leave empty if you are still deciding the orientation.
  north_deg        [float]    OPTIONAL Ladybug-style north angle (CCW from +Y to north); only used
                              when facing_deg is empty.  Default 0 (+Y is north).
  room_point       [Point3d]  OPTIONAL any point inside the room (orients the room surfaces);
                              only needed when you supply targets
  targets          [Brep]     OPTIONAL list: planar faces of the room (floor, back wall, side
                              walls, ceiling), each convex.  LEAVE EMPTY while the room is not
                              designed - gh_02 then builds an adjustable placeholder box room.
  hero_zones       [Curve]    optional list: closed planar curves drawn on those surfaces where you
                              WANT beams to land (a chair, a face height strip, an art wall)
  scene_path       [str]      where to write scene.json
  manual_mouths    [Curve]    optional override: clear-opening loops for a body ...
  manual_body      [str]      ... with the body name for each curve (housing/ring1/ring2/ring3)
  ang_tol_deg      [float]    curve sampling angle (default 8)

OUTPUTS
  scene_file   [str]    path written
  report       [str]    read this!  counts, warnings, straight-through open area
  mouth_curves [Curve]  detected clear-opening loops (HOME pose) - check they are right
  blocker_pts  [Point3d] blade hull points
  target_curves[Curve]  room surface outlines used

WHAT "MOUTH" MEANS: each tube section is hollow; its clear opening at each end is the INNER
edge loop of the end face.  Light reaches the room only if the sun ray passes every mouth and
misses the blades.  The script finds the mouths as the inner loops of planar end faces (or the
naked edges if your tubes are open surfaces).  Check `mouth_curves` visually.
"""
import math
import json
import os
import sys

import Rhino
import Rhino.Geometry as rg

TOL = 0.001
MIN_FACE_M2 = 0.25          # room faces smaller than this (slab edges, reveals) are ignored

# optional inputs: an input you did not add to the component simply counts as empty
TOP_CLOSE_DEG = 35.0        # top blade: degrees at Aperture Close = 100 (turns down, closing)
BOTTOM_CLOSE_DEG = 30.0     # bottom blade: degrees at Aperture Close = 100 (turns up, closing)

for _n in ("core_dir", "top_gain", "bottom_gain", "grid", "facing_deg", "north_deg", "room_point", "targets",
           "hero_zones", "scene_path", "manual_mouths", "manual_body", "ang_tol_deg", "context", "room",
           "use_context", "exterior_dir", "windows", "glazing", "energy_walls", "energy_walls_earth",
           "energy_common_walls", "energy_roof", "energy_floor_slab", "energy_floor_suspended", "energy_doors"):
    globals().setdefault(_n, None)


# ------------------------------------------------------------------ helpers
def _geo(x):
    """Parameters that reference objects in the Rhino file can arrive as bare Guids - get the geometry."""
    import System
    if isinstance(x, System.Guid):
        obj = Rhino.RhinoDoc.ActiveDoc.Objects.FindId(x)
        return obj.Geometry if obj is not None else None
    if isinstance(x, (list, tuple)):
        return [_geo(i) for i in x]
    return x


def _triangles(geoms):
    """Triangles (9 floats each) of Breps / Meshes / Extrusions - the shading context."""
    tris = []
    for g in geoms:
        if g is None:
            continue
        if not isinstance(g, rg.Mesh) and hasattr(g, "ToBrep"):
            g = g.ToBrep()
        if isinstance(g, rg.Mesh):
            meshes = [g]
        elif isinstance(g, rg.Brep):
            meshes = list(rg.Mesh.CreateFromBrep(g, rg.MeshingParameters.FastRenderMesh) or [])
        else:
            continue
        for m in meshes:
            vs = [(float(v.X), float(v.Y), float(v.Z)) for v in m.Vertices]
            for f in m.Faces:
                idx = [(f.A, f.B, f.C)]
                if f.IsQuad:
                    idx.append((f.A, f.C, f.D))
                for (i, j, k) in idx:
                    tris.append([round(c, 4) for c in vs[i] + vs[j] + vs[k]])
    return tris


def _pt(p):
    return (float(p.X), float(p.Y), float(p.Z))


def _dist(a, b):
    return math.sqrt((a[0] - b[0]) ** 2 + (a[1] - b[1]) ** 2 + (a[2] - b[2]) ** 2)


def _poly_pts(crv, ang_deg, tol):
    ok, pl = crv.TryGetPolyline()
    if not ok:
        pc = crv.ToPolyline(0, 0, math.radians(ang_deg), 0.0, 0.0, tol, 0.0, 0.0, True)
        if pc is None:
            return None
        ok, pl = pc.TryGetPolyline()
        if not ok:
            return None
    pts = [_pt(p) for p in pl]
    if len(pts) > 2 and _dist(pts[0], pts[-1]) < 1e-9:
        pts = pts[:-1]
    return pts


def _mouths_of(brep, ang_deg, tol):
    """Inner loops of planar faces (end faces of a hollow tube); fall back to naked edges."""
    curves = []
    for face in brep.Faces:
        if not face.IsPlanar(tol):
            continue
        for loop in face.Loops:
            if loop.LoopType == rg.BrepLoopType.Inner:
                c = loop.To3dCurve()
                if c is not None and c.IsClosed:
                    curves.append(c)
    if not curves:
        naked = brep.DuplicateNakedEdgeCurves(True, True)
        if naked:
            curves = [c for c in rg.Curve.JoinCurves(naked, tol * 10) if c.IsClosed]
    out = []
    for c in curves:
        pts = _poly_pts(c, ang_deg, tol)
        if pts and len(pts) >= 3:
            out.append(pts)
    return out


def _is_convex(pts):
    n = len(pts)
    if n < 4:
        return True
    # Newell normal
    nx = ny = nz = 0.0
    for i in range(n):
        a, b = pts[i], pts[(i + 1) % n]
        nx += (a[1] - b[1]) * (a[2] + b[2])
        ny += (a[2] - b[2]) * (a[0] + b[0])
        nz += (a[0] - b[0]) * (a[1] + b[1])
    sign = 0
    for i in range(n):
        a, b, c = pts[i], pts[(i + 1) % n], pts[(i + 2) % n]
        u = (b[0] - a[0], b[1] - a[1], b[2] - a[2])
        v = (c[0] - b[0], c[1] - b[1], c[2] - b[2])
        cx = u[1] * v[2] - u[2] * v[1]
        cy = u[2] * v[0] - u[0] * v[2]
        cz = u[0] * v[1] - u[1] * v[0]
        d = cx * nx + cy * ny + cz * nz
        if abs(d) < 1e-12:
            continue
        s = 1 if d > 0 else -1
        if sign == 0:
            sign = s
        elif s != sign:
            return False
    return True


def _area3(pts):
    """Area of a (nearly planar) closed 3D polygon."""
    sx = sy = sz = 0.0
    n = len(pts)
    for i in range(n):
        a, b = pts[i], pts[(i + 1) % n]
        sx += a[1] * b[2] - a[2] * b[1]
        sy += a[2] * b[0] - a[0] * b[2]
        sz += a[0] * b[1] - a[1] * b[0]
    return 0.5 * math.sqrt(sx * sx + sy * sy + sz * sz)


def _support_points(brep, n_dirs=96):
    """Vertices that define the convex hull of a blade, thinned to <= n_dirs points."""
    meshes = rg.Mesh.CreateFromBrep(brep, rg.MeshingParameters.FastRenderMesh)
    verts = []
    for m in (meshes or []):
        for v in m.Vertices:
            verts.append((float(v.X), float(v.Y), float(v.Z)))
    if not verts:
        return []
    out = {}
    golden = math.pi * (3.0 - math.sqrt(5.0))
    for k in range(n_dirs):
        z = 1.0 - 2.0 * (k + 0.5) / n_dirs
        r = math.sqrt(max(0.0, 1.0 - z * z))
        d = (r * math.cos(golden * k), r * math.sin(golden * k), z)
        best = max(verts, key=lambda p: p[0] * d[0] + p[1] * d[1] + p[2] * d[2])
        out[best] = 1
    return list(out.keys())


BLADE_END_SLICES = 4      # convex pieces through each curved blade end (the flat middle is one more piece)
BLADE_END_SHARE = 0.2     # share of the blade's length at each end that is sliced


def _support_of(pts, n_dirs=48):
    """The points of ``pts`` that matter for its convex hull (extreme in n_dirs directions)."""
    out = {}
    golden = math.pi * (3.0 - math.sqrt(5.0))
    for k in range(n_dirs):
        z = 1.0 - 2.0 * (k + 0.5) / n_dirs
        r = math.sqrt(max(0.0, 1.0 - z * z))
        d = (r * math.cos(golden * k), r * math.sin(golden * k), z)
        out[max(pts, key=lambda p: p[0] * d[0] + p[1] * d[1] + p[2] * d[2])] = 1
    return list(out.keys())


def _blocker_pieces(brep, end_slices=BLADE_END_SLICES, end_share=BLADE_END_SHARE, tol=0.001):
    """A blade as CONVEX PIECES, not one convex hull: the blades are thin plates whose ends curve round with the
    tube, and one hull fills the space between the curved ends - from most sun angles it blocks a slit the real
    blade leaves open (found 2026-10-07 by ray-tracing the real Breps: 1.45 m2 of sun the old model called 0).
    The blade is cut across its length: the flat middle is one piece, each end zone end_slices pieces, every cut
    an exact cross-section (Brep / plane) so neighbouring pieces meet without a gap.  Falls back to one hull when
    sections are not available."""
    mp = getattr(rg.MeshingParameters, "QualityRenderMesh", None)
    if mp is None or not hasattr(rg, "Plane"):
        return [_support_points(brep)]                   # (a reduced RhinoCommon, e.g. the tests' stand-in)
    meshes = rg.Mesh.CreateFromBrep(brep, mp)
    verts = [(float(v.X), float(v.Y), float(v.Z)) for m in (meshes or []) for v in m.Vertices]
    if len(verts) < 4:
        return [_support_points(brep)]
    n = float(len(verts))
    c = tuple(sum(p[i] for p in verts) / n for i in range(3))
    cov = [[sum((p[i] - c[i]) * (p[j] - c[j]) for p in verts) for j in range(3)] for i in range(3)]
    v = [1.0, 0.3, 0.1]
    for _ in range(60):                                   # the length axis: dominant eigenvector (power iteration)
        w = [sum(cov[i][j] * v[j] for j in range(3)) for i in range(3)]
        s = math.sqrt(sum(x * x for x in w)) or 1.0
        v = [x / s for x in w]
    t = [sum((p[i] - c[i]) * v[i] for i in range(3)) for p in verts]
    t0, t1 = min(t), max(t)
    e = (t1 - t0) * end_share
    cuts = sorted(set([round(t0 + e * k / end_slices, 9) for k in range(end_slices + 1)] +
                      [round(t1 - e + e * k / end_slices, 9) for k in range(end_slices + 1)]))
    sec = {}
    try:
        import Rhino.Geometry.Intersect as rgi
        for x in cuts[1:-1]:
            o = rg.Point3d(c[0] + v[0] * x, c[1] + v[1] * x, c[2] + v[2] * x)
            ok, crvs, _pts = rgi.Intersection.BrepPlane(brep, rg.Plane(o, rg.Vector3d(*v)), tol)
            sec[x] = [(float(q.X), float(q.Y), float(q.Z)) for cv in (crvs or [])
                      for q in [cv.PointAt(cv.Domain.ParameterAt(k / 32.0)) for k in range(33)]]
            if not sec[x]:
                raise ValueError("no section")
    except Exception:
        return [_support_points(brep)]                   # no exact sections here: the old single hull
    pieces = []
    for a, b in zip(cuts, cuts[1:]):
        pts = [p for p, tt in zip(verts, t) if a - 1e-9 <= tt <= b + 1e-9] + sec.get(a, []) + sec.get(b, [])
        if len(pts) >= 4:
            pieces.append(_support_of(pts))
    return pieces


def _parse_grid(text):
    out = {}
    for tok in text.replace(";", " ").split():
        name, rng = tok.split("=")
        a, b, n = rng.split(":")
        a, b, n = float(a), float(b), int(n)
        out[name] = [a] if n <= 1 else [a + (b - a) * i / (n - 1.0) for i in range(n)]
    return out


def _curve_from_pts(pts, close=True):
    pl = rg.Polyline([rg.Point3d(*p) for p in pts])
    if close and pl.Count > 0:
        pl.Add(pl[0])
    return rg.PolylineCurve(pl)


# ------------------------------------------------------------------ main
def main():
    if not build:
        return None
    g = globals()
    for _n in ("housing", "ring1", "ring2", "ring3", "blade_top", "blade_bottom", "axis_ring1", "axis_ring2",
               "axis_ring3", "axis_blade_top", "axis_blade_bottom", "targets", "hero_zones", "manual_mouths",
               "context", "room"):
        g[_n] = _geo(g.get(_n))
    for _n in ("targets", "hero_zones", "manual_mouths", "context", "room"):   # a single item counts as a list
        if g.get(_n) is not None and not isinstance(g[_n], (list, tuple)):
            g[_n] = [g[_n]]
    # ---- one combined 'room' input: Breps = room faces, curves = hero zones, a point = a spot inside the room
    rf, rh, rpt = list(g.get("targets") or []), list(g.get("hero_zones") or []), g.get("room_point")
    skipped = 0
    for it in (g.get("room") or []):
        if it is None:
            continue
        if hasattr(it, "ToBrep") and not isinstance(it, (rg.Brep, rg.Curve)):
            it = it.ToBrep()                                               # extrusions
        if isinstance(it, rg.Brep):
            rf.append(it)
        elif isinstance(it, rg.Curve):
            rh.append(it)
        elif isinstance(it, rg.Point):
            rpt = it.Location
        elif isinstance(it, rg.Point3d):
            rpt = it
        else:
            skipped += 1
    g["targets"], g["hero_zones"], g["room_point"] = (rf or None), (rh or None), rpt
    if core_dir and core_dir not in sys.path:
        sys.path.insert(0, core_dir)
    import importlib
    import window_beams_core as core
    importlib.reload(core)                     # always use the engine file on disk, not a stale cached copy

    ang =float(ang_tol_deg) if ang_tol_deg else 8.0
    doc = Rhino.RhinoDoc.ActiveDoc
    tol = doc.ModelAbsoluteTolerance if doc else TOL
    units_to_m = Rhino.RhinoMath.UnitScale(doc.ModelUnitSystem, Rhino.UnitSystem.Meters) if doc else 1.0
    notes = []

    # ---- parameters & joints
    grid_txt = grid or "ring=0:15:11 aperture=0:100:11"
    grid_d = _parse_grid(grid_txt)
    independent = ("ring1" in grid_d) or ("ring2" in grid_d) or ("ring3" in grid_d)
    ring_param = lambda k: ("ring%d" % k) if independent else "ring"
    params = [{"name": n, "values": v} for n, v in grid_d.items()]

    def joint(name, crv, param, gain):
        a, b = crv.PointAtStart, crv.PointAtEnd
        ax = (b.X - a.X, b.Y - a.Y, b.Z - a.Z)
        if math.sqrt(sum(c * c for c in ax)) < 1e-9:
            raise ValueError("axis curve for %s has zero length" % name)
        return {"name": name, "origin": _pt(a), "axis": ax, "param": param, "gain": gain}

    joints = [
        joint("j1", axis_ring1, ring_param(1), 1.0),
        joint("j2", axis_ring2, ring_param(2), 1.0),
        joint("j3", axis_ring3, ring_param(3), 1.0),
        joint("jt", axis_blade_top, "aperture", 0.0),         # gains set below, once the window's centre line
        joint("jb", axis_blade_bottom, "aperture", 0.0),      # is known (they must CLOSE the aperture)
    ]

    # ---- bodies (chain = joints that move the body, root -> tip, same order as your RotAx chain)
    manual = {}
    if manual_mouths:
        for c, b in zip(manual_mouths, manual_body or []):
            pts = _poly_pts(c, ang, tol)
            if pts:
                manual.setdefault(b, []).append(pts)

    def mouths(name, brep):
        if name in manual:
            return manual[name]
        return _mouths_of(brep, ang, tol)

    bodies = [
        {"name": "housing", "chain": [], "mouths": mouths("housing", housing), "blockers": []},
        {"name": "ring1", "chain": ["j1"], "mouths": mouths("ring1", ring1), "blockers": []},
        {"name": "ring2", "chain": ["j1", "j2"], "mouths": mouths("ring2", ring2), "blockers": []},
        {"name": "ring3", "chain": ["j1", "j2", "j3"], "mouths": mouths("ring3", ring3), "blockers": []},
        {"name": "blade_top", "chain": ["j1", "j2", "j3", "jt"], "mouths": [],
         "blockers": _blocker_pieces(blade_top)},
        {"name": "blade_bottom", "chain": ["j1", "j2", "j3", "jb"], "mouths": [],
         "blockers": _blocker_pieces(blade_bottom)},
    ]
    for b in bodies:
        if b["name"].startswith("blade"):
            if not b["blockers"] or len(b["blockers"][0]) < 4:
                notes.append("WARNING: %s gave fewer than 4 hull points" % b["name"])
            else:
                notes.append("%s: %d convex piece(s) (the flat middle + slices through the curved ends)" % (
                    b["name"], len(b["blockers"])))
            continue
        n = len(b["mouths"])
        if n == 0:
            raise ValueError("No clear-opening loops found on %s. Supply manual_mouths/manual_body." % b["name"])
        if n != 2:
            notes.append("NOTE: %s has %d mouth loops (expected 2: one at each end). Check mouth_curves." % (b["name"], n))
        for m in b["mouths"]:
            hull = core.convexify_loop(m, max_pts=10000)
            if _area3(m) < 0.93 * _area3(hull):
                notes.append("WARNING: a %s mouth is clearly non-convex (%.0f%% of its hull) - the engine uses "
                             "the convex hull, so light may leak past the dent." % (b["name"], 100 * _area3(m) / _area3(hull)))

    # ---- room surfaces (optional - gh_02 builds a placeholder room when there are none)
    # Every PLANAR face of every Brep you supply is a candidate. For solids (slabs, wall blocks) only faces whose
    # outward normal points toward the inside of the room are kept; open surfaces are turned to face the room.
    tg, tcurves = [], []
    breps = []
    for tb in (targets or []):
        if hasattr(tb, "ToBrep") and not isinstance(tb, rg.Brep):
            tb = tb.ToBrep()
        breps.append(tb)
    if breps and room_point is None:                       # no point given: centre of everything supplied
        cloud = []
        for tb in breps:
            for face in tb.Faces:
                cloud += _poly_pts(face.OuterLoop.To3dCurve(), ang, tol) or []
        rp = tuple((max(p[i] for p in cloud) + min(p[i] for p in cloud)) / 2.0 for i in range(3))
        notes.append("NOTE: no room point given - used the centre of the room geometry (%.2f, %.2f, %.2f)." % rp)
    else:
        rp = (room_point.X, room_point.Y, room_point.Z) if room_point is not None else (0.0, 0.0, 0.0)
    if skipped:
        notes.append("NOTE: %d object(s) in 'room' were not a Brep, curve or point and were ignored." % skipped)
    if not breps:
        notes.append("NOTE: no room faces supplied - gh_02 will use the adjustable placeholder room.")
    cnt = {"faces": 0, "used": 0, "away": 0, "tiny": 0, "nonplanar": 0, "hulled": 0, "dup": 0}
    seen = set()
    for bi, tb in enumerate(breps):
        solid = bool(getattr(tb, "IsSolid", False))
        inward = str(getattr(tb, "SolidOrientation", "")).endswith("Inward")
        for fi, face in enumerate(tb.Faces):
            cnt["faces"] += 1
            ok, plane = face.TryGetPlane(tol)
            if not ok:
                cnt["nonplanar"] += 1
                continue
            outer = _poly_pts(face.OuterLoop.To3dCurve(), ang, tol)
            if not outer or len(outer) < 3:
                cnt["nonplanar"] += 1
                continue
            c = tuple(sum(p[i] for p in outer) / len(outer) for i in range(3))
            n = (plane.ZAxis.X, plane.ZAxis.Y, plane.ZAxis.Z)
            to_room = sum((rp[i] - c[i]) * n[i] for i in range(3))
            if solid:
                if bool(getattr(face, "OrientationIsReversed", False)) != inward:
                    n = (-n[0], -n[1], -n[2])                              # outward normal of the solid
                    to_room = -to_room
                if to_room <= 0:
                    cnt["away"] += 1                                       # outer / back face of a slab
                    continue
            elif to_room < 0:
                n = (-n[0], -n[1], -n[2])                                  # open surface: face the room
            o = _pt(plane.Origin)
            e1 = (plane.XAxis.X, plane.XAxis.Y, plane.XAxis.Z)
            e2 = (plane.YAxis.X, plane.YAxis.Y, plane.YAxis.Z)
            to2d = lambda p: (sum((p[i] - o[i]) * e1[i] for i in range(3)), sum((p[i] - o[i]) * e2[i] for i in range(3)))
            bnd = [to2d(p) for p in outer]
            if core.poly_area(bnd) * units_to_m ** 2 < MIN_FACE_M2:
                cnt["tiny"] += 1
                continue
            key = (tuple(round(v, 3) for v in c), tuple(round(v, 3) for v in n), round(core.poly_area(bnd), 3))
            if key in seen:                                                # same face supplied twice
                cnt["dup"] += 1
                continue
            seen.add(key)
            if not _is_convex(outer):
                bnd = core.convex_hull(bnd)                                # the engine needs convex faces
                cnt["hulled"] += 1
            tg.append({"name": "face%d_%d" % (bi, fi), "origin": o, "normal": n, "e1": e1, "e2": e2,
                       "boundary": bnd, "heroes": [], "weight": 1.0})
            tcurves.append(_curve_from_pts(outer))
            cnt["used"] += 1
    if breps:
        notes.append("room faces: %d Brep(s) -> %d face(s) used  (skipped: %d back/outer faces, %d tiny, %d curved; "
                     "%d concave faces replaced by their convex hull)" % (
                         len(breps), cnt["used"], cnt["away"], cnt["tiny"], cnt["nonplanar"], cnt["hulled"]))
        if cnt["dup"]:
            notes.append("NOTE: %d duplicate face(s) ignored - the same room geometry is probably wired in twice "
                         "(check what feeds the 'room' input)." % cnt["dup"])
        if cnt["used"] == 0:
            notes.append("WARNING: no usable room face found - the placeholder room will be used.")
    for hc in (hero_zones or []):
        pts = _poly_pts(hc, ang, tol)
        if not pts:
            continue
        placed = False
        for t in tg:
            o, n = t["origin"], t["normal"]
            if all(abs(sum((p[i] - o[i]) * n[i] for i in range(3))) < tol * 20 for p in pts):
                e1, e2 = t["e1"], t["e2"]
                t["heroes"].append([(sum((p[i] - o[i]) * e1[i] for i in range(3)),
                                     sum((p[i] - o[i]) * e2[i] for i in range(3))) for p in pts])
                placed = True
                break
        if not placed:
            notes.append("NOTE: a hero_zone curve does not lie on any target surface - ignored.")

    # ---- exterior direction: yours if given, otherwise read off the window geometry
    given = None
    if exterior_dir is not None:
        v = (exterior_dir.X, exterior_dir.Y, exterior_dir.Z)
        if v[0] ** 2 + v[1] ** 2 + v[2] ** 2 > 1e-12:
            given = core.vunit(v)
    if given is not None:
        ext = given
        notes.append("exterior direction: as given (%.3f, %.3f, %.3f)." % ext)
    else:
        est = core.estimate_exterior_dir({"joints": joints, "bodies": bodies})
        ext = est["dir"]
        notes.append("exterior direction: AUTO from the window geometry = (%.3f, %.3f, %.3f)%s. The chain sticks "
                     "out %.2f m from the housing toward it; the sun must come from that side. Wrong way? Give "
                     "an exterior direction vector to override." % (
                         ext[0], ext[1], ext[2],
                         " (snapped to the model axis, %.1f deg off)" % est["axis_angle_deg"] if est["snapped"]
                         else " (%.1f deg from the nearest model axis - not snapped)" % est["axis_angle_deg"],
                         est["chain_length"] * units_to_m))

    # ---- rings: a positive Ring Angle tilts the tube UP (0 = straight out).  An axis curve drawn the other way
    # (your definition reverses ring axis 2 with a Line from its end to its start) is flipped here to match.
    for jn in ("j1", "j2", "j3"):
        j = [x for x in joints if x["name"] == jn][0]
        if core.tilt_up_sign(j, ext) < 0:
            j["origin"] = tuple(j["origin"][k] + j["axis"][k] for k in range(3))      # = the curve's end point
            j["axis"] = tuple(-c for c in j["axis"])
            notes.append("ring axis %s: the curve points the other way - reversed so a positive Ring Angle tilts "
                         "the tube up, like the other rings" % jn[1])

    # ---- scene
    scene = {"units_to_m": units_to_m, "north_deg": float(north_deg or 0.0), "exterior_dir": ext,
             "params": params, "joints": joints, "bodies": bodies, "targets": tg}
    if facing_deg is not None:
        core.apply_orientation(scene, float(facing_deg))
    rs = core.room_stats(scene)
    if rs:
        notes.append("room from your faces: floor %.1f m2, volume %.1f m3, surface %.1f m2 (used for the indoor "
                     "temperature model and for where beams land)" % (rs["floor_m2"], rs["volume_m3"], rs["surface_m2"]))
    ctx_tris = _triangles(context or []) if use_context is None or use_context else []
    if use_context is not None and not use_context:
        notes.append("shading context is switched OFF - nothing shades the window.")
    elif ctx_tris:
        scene["context"] = {"triangles": ctx_tris}
        notes.append("context shading: %d triangles from %d object(s)%s" % (
            len(ctx_tris), len(context), "  (WARNING: >20000 triangles is slow - use a coarser/simpler model)"
            if len(ctx_tris) > 20000 else ""))
        notes.append("NOTE: make sure the building you pick has the window opening cut out, or is simply the "
                     "surroundings (overhangs, neighbours). Triangles inside the window's own box are ignored.")
    else:
        notes.append("NOTE: no context geometry - nothing shades the window.")
    # exit point = centre of the interior-most mouth
    best = None
    for b in bodies:
        for m in b["mouths"]:
            c = tuple(sum(p[i] for p in m) / len(m) for i in range(3))
            d = sum(c[i] * ext[i] for i in range(3))
            if best is None or d < best[0]:
                best = (d, c)
    scene["exit_point"] = best[1]

    # ---- the building's components for the energy model, each from its own input (you choose what is what);
    # an empty input = worked out from the room faces instead
    kinds = ("walls", "walls_earth", "common_walls", "roof", "floor_slab", "floor_suspended", "doors")
    comp_in = dict((k, [x for x in _geo(list(globals().get("energy_" + k) or [])) if x is not None]) for k in kinds)
    gl_in = [x for x in _geo(list(glazing or [])) if x is not None]
    if gl_in or any(comp_in.values()):
        import energy_geometry as eg
        importlib.reload(eg)
        centre = eg.centre_of([x for k in kinds[:-1] for x in comp_in[k]])
        if centre is None:
            if tg:
                centre = rg.Point3d(*[sum(t["origin"][i] for t in tg) / len(tg) for i in range(3)])
            else:
                centre = rg.Point3d(*[scene["exit_point"][i] - 3.0 / units_to_m * ext[i] for i in range(3)])
        gl_out = eg.glazing_pieces(gl_in, centre, lambda crv: _poly_pts(crv, ang, tol))
        if gl_out:
            scene["glazing"] = gl_out
            notes.append("glazing: %d piece(s), %.2f m2 (areas + the way they face, for the energy model)" % (
                len(gl_out), sum(core.polygon_area3(g["polygon"]) for g in gl_out) * units_to_m ** 2))
        win_pts = [rg.Point3d(*scene["exit_point"])]
        gl_pts = [rg.Point3d(*g["centroid"]) for g in gl_out]
        egeo = {}
        dn = []
        if comp_in["doors"]:                       # doors first: walls need to know which doors sit in them
            egeo["doors"] = eg.element_faces(comp_in["doors"], centre, units_to_m, notes=dn)
        door_pts = [rg.Point3d(*d["centroid"]) for d in egeo.get("doors", [])]
        for k in kinds[:-1]:
            if comp_in[k]:
                kn = []
                egeo[k] = eg.element_faces(comp_in[k], centre, units_to_m, win_pts, gl_pts, door_pts, notes=kn)
                notes.extend("NOTE: %s: %s" % (k.replace("_", " "), x) for x in kn)
        notes.extend("NOTE: doors: %s" % x for x in dn)
        if egeo:
            scene["energy_geometry"] = egeo
            notes.append("energy model components from your inputs: " + ", ".join(
                "%s %.1f m2" % (k.replace("_", " "), sum(p["area_m2"] for p in v)) for k, v in egeo.items()) +
                "  (anything not wired in: worked out from the room faces)")

    # ---- blades: Aperture Close 0 -> 100 turns the top blade TOP_CLOSE_DEG and the bottom blade
    # BOTTOM_CLOSE_DEG, each the way that CLOSES the opening (toward the window's centre line)
    for jn, bn, given, deg in (("jt", "blade_top", top_gain, TOP_CLOSE_DEG),
                               ("jb", "blade_bottom", bottom_gain, BOTTOM_CLOSE_DEG)):
        sgn = core.closing_sign(joints, bodies, jn, bn, scene["exit_point"], ext)
        j = [x for x in joints if x["name"] == jn][0]
        j["gain"] = sgn * deg / 100.0 if given is None else float(given)
        ang = j["gain"] * 100.0
        R = core.rot_about_axis(tuple(j["origin"]), core.vunit(tuple(j["axis"])), math.radians(ang))
        pts = [tuple(p) for blk in [x for x in bodies if x["name"] == bn][0]["blockers"] for p in blk]
        dz = sum(core.mat_apply(R, p)[2] - p[2] for p in pts) / max(len(pts), 1)
        if given is not None and j["gain"] * sgn < 0:
            notes.append("WARNING: %s gain %g swings the blade OUTWARD (opens the aperture). Leave %s_gain empty "
                         "to have it close." % (bn, j["gain"], bn.split("_")[1]))
        else:
            notes.append("%s: Aperture Close 0 -> 100 turns it %.0f deg, %s toward the centre (closing)" % (
                bn, abs(ang), "down" if dz < 0 else "up"))

    # ---- more windows: copies of this one at other positions / facings, all sharing the one room.
    # Each plane: origin = centre of that window's inner opening, Z axis = the way it faces (the window stays upright).
    extra_wins = []
    plist = windows if isinstance(windows, (list, tuple)) else ([windows] if windows is not None else [])
    plist = [p for p in plist if p is not None]
    if plist:
        base = dict((k, scene[k]) for k in core.WINDOW_KEYS if k in scene)
        base["name"] = "window 1"
        wins = [base]
        for pl in plist:
            if hasattr(pl, "ZAxis"):
                origin, face = _pt(pl.Origin), (pl.ZAxis.X, pl.ZAxis.Y, pl.ZAxis.Z)
            else:
                loc = pl.Location if hasattr(pl, "Location") else pl         # a point: same facing as window 1
                origin, face = _pt(loc), ext
            wins.append(core.place_window(base, core.frame_upright(origin, face), name="window %d" % (len(wins) + 1)))
        scene["windows"] = wins
        extra_wins = wins[1:]
        for k, w in enumerate(wins):
            fd = core.facing_of_scene({"exterior_dir": w["exterior_dir"], "north_deg": scene["north_deg"]})
            notes.append("window %d at (%.2f, %.2f, %.2f) faces %s" % (
                k + 1, w["exit_point"][0], w["exit_point"][1], w["exit_point"][2],
                "n/a (up/down)" if fd is None else "%.0f deg %s" % (fd, core.compass_name(fd))))
        notes.append("%d windows will share one room (placeholder room, if used, is built around window 1)." % len(wins))

    path = scene_path or os.path.join(os.path.expanduser("~"), "window_scene.json")
    with open(path, "w") as f:
        json.dump(scene, f, indent=1)

    # ---- sanity: straight-through area at the first (home) pose
    mech = core.Mechanism(scene)
    pose0 = tuple(p["values"][0] for p in params)
    m0, b0 = mech.pose_geometry(pose0)
    pcs = core.clear_pieces(m0, b0, core.sun_basis(core.vunit(ext)))
    area_m2 = sum(core.poly_area(p) for p in pcs) * units_to_m ** 2
    lines = ["scene written: %s" % path,
             "units_to_m = %g   exterior_dir = (%.2f, %.2f, %.2f)" % (units_to_m, ext[0], ext[1], ext[2]),
             "poses in grid: %d" % len(mech.poses()),
             "mouths per body: " + ", ".join("%s=%d" % (b["name"], len(b["mouths"])) for b in bodies[:4]),
             "window faces (compass): %s" % (
                 "n/a (looks straight up/down)" if core.facing_of_scene(scene) is None
                 else "%.0f deg" % core.facing_of_scene(scene)),
             "targets: %d   hero zones: %d" % (len(tg), sum(len(t["heroes"]) for t in tg)),
             "open area looking straight through the window at the first pose: %.4f m2 (compare with the "
             "glazing/opening you expect)" % area_m2] + notes
    return {
        "scene_file": path,
        "report": "\n".join(lines),
        "mouth_curves": [_curve_from_pts(m) for b in bodies for m in b["mouths"]]
        + [_curve_from_pts(m) for w in extra_wins for b in w["bodies"] for m in b["mouths"]],
        "blocker_pts": [rg.Point3d(*p) for b in bodies for bl in b["blockers"] for p in bl],
        "target_curves": tcurves,
    }


_res = main()
if _res:
    scene_file = _res["scene_file"]
    report = _res["report"]
    mouth_curves = _res["mouth_curves"]
    blocker_pts = _res["blocker_pts"]
    target_curves = _res["target_curves"]
# ---------- end _1_build_scene ----------
build_report = Panel(_1_build_scene.report)
_2_run_scan = Python3Script(
    core_dir=code_folder,
    run=run_scan_switch_on_to_start_it_runs_in_t,
    scene_path=scene_json,
    epw_path=weather_file_epw_replace_with_the_real_n,
    out_dir=output_folder,
    facing_deg=facing_deg_0_n_90_e_180_s_270_w,
    beam_width_m=beam_width_m,
    w_motion=motion_penalty,
    overrides=extra_settings_json_see_config_default_j,
    beam_priority=priority_0_thermal_comfort_1_light_beam,
    monthly_targets=[target_indoor_temp_jan_degc, target_indoor_temp_feb_degc, target_indoor_temp_mar_degc, target_indoor_temp_apr_degc, target_indoor_temp_may_degc, target_indoor_temp_jun_degc, target_indoor_temp_jul_degc, target_indoor_temp_aug_degc, target_indoor_temp_sep_degc, target_indoor_temp_oct_degc, target_indoor_temp_nov_degc, target_indoor_temp_dec_degc],
    comfort_tol=comfort_tolerance_degc,
    time_step_min=time_step_minutes_1_minute_by_minute_60,
    cancel=cancel_the_running_scan,
    background=run_scans_in_the_background_grasshopper,
    smooth_minutes=motion_smoothing_minutes_steadier_moves,
    thermal_on=temperature_energy_model_off_light_only,
    building=_7_energy_inputs.building,
    break_up_every_s=break_up_moves_one_small_move_every_s_0,
    break_up_step_pct=largest_small_move_of_a_full_swing,
    consistency_on=beam_consistency_optimiser_off_v1_the_ea,
    drop_minutes=dropout_cost_beam_minutes_keep_the_beam,
    jump_minutes_per_m=beam_jump_cost_beam_minutes_per_metre)  # -> out, report, csv_path, scene_resolved, room_curves, param_names, pose_tree, beam_score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; inputs monthly_targets: list
# ---------- _2_run_scan: Python ----------
# -*- coding: utf-8 -*-
"""
gh_02_run_scan.py   -   Grasshopper "Python 3 Script" component (Rhino 8)
================================================================================
Runs the annual scan: every pose x every sunlit hour -> best pose per hour, for EVERY window in the scene
(one window, or several at different facings sharing one room) in a single run.
~0.3 s per pose.  The geometric scan is cached per (window, orientation, room, sun settings), so changing
weights / beam width / temperature targets afterwards re-scores in seconds.

IN THE BACKGROUND: switching RUN on starts the scan in a separate Python process (scan_worker.py) and returns at
once - Grasshopper and Rhino stay usable.  The `status` output (wire it to a panel) shows a progress bar, the
stage and the time left, the component's label shows the percentage, and when the scan has finished its results
appear on the outputs and the preview / time-lapse components refresh by themselves.  `cancel` stops it.

INPUTS
  core_dir     [str]    folder containing window_beams_core.py
  run          [bool]   toggle - switching it ON starts a scan (in the background; leave it on or off after)
  cancel       [bool]   OPTIONAL toggle - switching it ON stops the running scan
  background   [bool]   OPTIONAL - False = the old way: run inside Grasshopper, which freezes until done (default True)
  scene_path   [str]    scene.json from gh_01_build_scene
  epw_path     [str]    Newcastle .epw (see README for the file to use)
  out_dir      [str]    folder for the scan documents, scene_resolved.json and the caches
  monthly_targets [float] OPTIONAL list of 12 numbers (Jan..Dec) or 1 number: the indoor temperature you want in
                        each month, degC. Wire twelve sliders in month order. Default 22.5 all year.
  comfort_tol  [float]  OPTIONAL +- degC around the target that still counts as comfortable (default 2.5)
  beam_priority [float] OPTIONAL 0..1: 0 = thermal comfort only, 1 = light beam only (default ~0.63 = the
                        balance used so far). Sets w_beam = 1.6 p and w_thermal = 1.6 (1 - p).
  facing_deg   [float]  OPTIONAL compass bearing the FIRST window faces: 0 N, 90 E, 180 S, 270 W. Other windows
                        keep their positions relative to it (the whole building turns). Empty = as built.
  beam_width_m [float]  OPTIONAL target beam width in metres (default 0.30)
  smooth_minutes [float] OPTIONAL steadier motion (0 = off).  Beam consistency optimiser: a change of setting must
                        win back change_per_smooth (0.4) x this many beam-minutes - inside the search, so no beam is
                        given up for nothing.  v1: running median over this many minutes + a minimum hold, afterwards
  consistency_on [bool] OPTIONAL True (default) = the BEAM CONSISTENCY optimiser (keeps a visible beam of the target
                        width going and steady for as much of the time as the geometry allows); False = v1, the
                        earlier optimiser and beam score
  drop_minutes  [float] OPTIONAL consistency: a beam lost while another setting could keep it costs this many
                        beam-minutes (default 60)
  jump_minutes_per_m [float] OPTIONAL consistency: a move that makes the beam's landing spot jump costs this many
                        beam-minutes per metre (default 2 - the tie-break between moves keeping the same beam time)
  break_up_every_s [float] OPTIONAL post-processing, no sudden jumps: every change of setting becomes small moves,
                        one every this many seconds, centred on the change (0 = off: one move per change).  The
                        time-lapse plays them; motion_steps.csv lists every small move to the second.
  break_up_step_pct [float] OPTIONAL largest single small move, % of a parameter's full range (default 5)
  time_step_min [int]   OPTIONAL time resolution in minutes: 60 = one decision per hour (default), 1 = minute by
                        minute (any divisor of 60 works: 1, 2, 5, 10, 15, 30).  Shorter steps scan more sun
                        positions: on your window minute steps take ~10 min the first time (cached afterwards).
  w_motion     [float]  OPTIONAL penalty for moving the window (default 0.02)
  thermal_on   [bool]   OPTIONAL toggle: True (default) = the building's indoor temperature (energy calculator
                        workbook model) takes part; False = LIGHT ONLY - no temperature / energy, faster
  building     [str]    OPTIONAL json from 7 ENERGY INPUTS: the values entered by hand (U-values, roof colour,
                        g-value, shading, air changes, people, thermal mass) for the energy calculator formulas.  The
                        AREAS come from the geometry every run.  Empty = the workbook's placeholder values.
  building_xlsx [str]   OPTIONAL path of the workbook - only adds a check that the formulas reproduce its results.
  config_path  [str]    OPTIONAL json file of settings (copy config.default.json, keep what you change)
  overrides    [str]    OPTIONAL json text, wins over the config file, e.g.
                        {"room": {"depth_m": 6}, "occupied_hours": [8, 18], "monthly_target_c": [24,24,23,22,21,20,20,20,21,22,23,24]}
  Precedence: defaults < config_path < overrides < the direct inputs above.
  (w_thermal / w_beam still work; beam_priority wins if both are given.)

OUTPUTS
  status         [str]    progress of the background scan: bar, percentage, stage, time elapsed / left
  progress       [float]  0..1
  report         [str]    summary (put it in a Panel)
  scan_folder    [str]    the NEW folder written for this scan (never overwrites an earlier scan): report.html,
                          schedule.csv (every daylight time step - every minute with time_step_min = 1 - Excel-
                          friendly), hourly_8760.csv, poses_by_step.json, summary.txt, settings.json,
                          scene_resolved.json, motion_steps.csv (moves broken up only).  <out_dir>/scans/index.csv
                          lists every scan.
  poses_path     [str]    <out_dir>/poses_by_step.json = the latest scan's setting at every step (time-lapse viewer)
  report_html    [str]    path of this scan's visual report - open it in a browser
  csv_path       [str]    <out_dir>/schedule.csv = copy of the LATEST scan's hourly_8760.csv (gh_03_preview)
  scene_resolved [str]    <out_dir>/scene_resolved.json = copy of the latest scan's scene -> gh_03_preview
  room_curves    [Curve]  outlines of the room faces used (the placeholder box if you gave none)
  window_names   [str]    one per window
  param_names    [str]    one window: ring, aperture.  Several: w1_ring, w1_aperture, w2_ring, ...
  pose_tree      [float]  Tree: one window: branch {k} = chosen value of parameter k for hoy 0..8759 (the
                          middle of each hour when the time step is shorter).  several windows: branch {window; k}
  beam_score, gain_w, tau_eff [float]  8760 values per window (hourly means with shorter steps): a flat list for
                          one window, a Tree with one branch per window for several
  indoor_temp    [float]  8760 values, degC: simulated room temperature (all windows together)
  sun_alt, sun_az [float] 8760 values
"""
import sys
import os
import csv
import json
import importlib

import Grasshopper
from Grasshopper.Kernel.Data import GH_Path
import Rhino.Geometry as rg
import scriptcontext as sc

# optional inputs: an input you did not add to the component simply counts as empty
for _n in ("core_dir", "out_dir", "facing_deg", "beam_width_m", "config_path", "overrides",
           "w_thermal", "w_motion", "w_beam", "monthly_targets", "comfort_tol", "beam_priority", "time_step_min",
           "cancel", "background", "smooth_minutes", "thermal_on", "building_xlsx", "building", "break_up_every_s",
           "break_up_step_pct", "consistency_on", "drop_minutes", "jump_minutes_per_m"):
    globals().setdefault(_n, None)

OUTPUT_NAMES = ("status", "progress", "report", "scan_folder", "report_html", "csv_path", "poses_path",
                "scene_resolved", "room_curves", "window_names", "param_names", "pose_tree", "beam_score", "gain_w",
                "tau_eff", "indoor_temp", "sun_alt", "sun_az")


def _flat(x):
    if x is None:
        return None
    return [float(v) for v in (x if isinstance(x, (list, tuple)) else [x])]


def _component():
    try:
        return ghenv.Component                                   # noqa: F821  (provided by Grasshopper)
    except NameError:
        return None


def _outputs(core, res):
    """The component's outputs, from a finished scan's result and files."""
    docs = res["docs"]
    with open(docs["hourly_csv"]) as f:
        rows = list(csv.DictReader(f))
    num = lambda v: float(v) if v not in ("", None) else None
    multi = res["n_windows"] > 1
    names, tree = [], Grasshopper.DataTree[float]()
    for w, (pre, pn) in enumerate(zip(res["prefixes"], res["pose_names"])):
        for k, name in enumerate(pn):
            names.append(pre + name)
            path = GH_Path(w, k) if multi else GH_Path(k)
            for r in rows:
                tree.Add(float(r[pre + name]), path)

    def per_window(key):
        if not multi:
            return [num(r[key]) for r in rows]
        t = Grasshopper.DataTree[float]()
        for w, pre in enumerate(res["prefixes"]):
            for r in rows:
                t.Add(float(r[pre + key]), GH_Path(w))
        return t

    with open(docs["latest_scene"]) as f:
        scene = json.load(f)
    room = []
    for pts in core.targets_outline_3d(scene).values():
        pl = rg.Polyline([rg.Point3d(*p) for p in pts])
        pl.Add(pl[0])
        room.append(rg.PolylineCurve(pl))
    return {
        "report": res["report"], "scan_folder": docs["folder"], "report_html": docs["report_html"],
        "csv_path": docs["latest_csv"], "poses_path": docs["latest_poses"], "scene_resolved": docs["latest_scene"],
        "room_curves": room, "window_names": res["window_names"], "param_names": names, "pose_tree": tree,
        "beam_score": per_window("beam_score"), "gain_w": per_window("gain_w"), "tau_eff": per_window("tau_eff"),
        "indoor_temp": [num(r["indoor_temp"]) for r in rows], "sun_alt": [float(r["sun_alt"]) for r in rows],
        "sun_az": [float(r["sun_az"]) for r in rows],
    }


def _schedule(comp, ms, fn, key):
    """Run fn(doc) before a Grasshopper solution in ``ms`` milliseconds (keeps the delegate alive)."""
    from Grasshopper.Kernel import GH_Document
    d = GH_Document.GH_ScheduleDelegate(fn)
    sc.sticky[key] = d
    comp.OnPingDocument().ScheduleSolution(ms, d)


def main():
    if core_dir and core_dir not in sys.path:
        sys.path.insert(0, core_dir)
    import building_energy
    import window_beams_core as core
    import background_jobs as bj
    import scan_worker
    for m in (building_energy, core, bj, scan_worker):
        importlib.reload(m)
    comp = _component()
    bg = comp is not None and (background is None or bool(background))
    if not bg and not run:
        return None

    targets = _flat(monthly_targets)
    if targets is not None and len(targets) not in (1, 12):
        raise ValueError("monthly_targets needs 12 numbers (Jan..Dec) or 1, got %d - wire all twelve sliders "
                         "in month order" % len(targets))
    over = core.load_overrides(config_path, overrides, facing_deg=facing_deg, beam_width_m=beam_width_m,
                               w_thermal=w_thermal, w_motion=w_motion, w_beam=w_beam,
                               monthly_target_c=(targets[0] if targets and len(targets) == 1 else targets),
                               comfort_tolerance_c=comfort_tol, beam_priority=beam_priority,
                               time_step_min=time_step_min, smooth_minutes=smooth_minutes,
                               break_up_every_s=break_up_every_s,
                               optimizer=(None if consistency_on is None else
                                          ("consistency" if bool(consistency_on) else "v1")),
                               beam_score_model=(None if consistency_on is None else
                                                 ("v2" if bool(consistency_on) else "v1")),
                               drop_minutes=drop_minutes, jump_minutes_per_m=jump_minutes_per_m,
                               break_up_max_share=(None if break_up_step_pct is None else
                                                   float(break_up_step_pct) / 100.0),
                               thermal_on=(None if thermal_on is None else bool(thermal_on)),
                               building_xlsx=(str(building_xlsx).strip() or None) if building_xlsx else None,
                               building=(json.loads(str(building)) if building and str(building).strip() else None))
    folder = out_dir or os.path.dirname(scene_path)
    if not os.path.isdir(folder):
        os.makedirs(folder)
    params = {"scene_path": scene_path, "epw_path": epw_path, "overrides": over, "out_dir": folder,
              "cache_dir": os.path.join(folder, "_cache")}

    if not bg:                                            # in-process (tests, command line, background = False)
        res = scan_worker.run_job({"kind": "scan", "core_dir": core_dir, "params": params})
        print("new scan documents: " + res["docs"]["folder"])
        out = _outputs(core, res)
        out["status"], out["progress"] = "scan finished in %.0f s" % res["seconds"], 1.0
        return out

    key = ("wbc_scan_job", str(comp.InstanceGuid))
    st = sc.sticky.setdefault(key, {"handle": None, "run": False, "cancel": False, "outputs": None,
                                    "status": "no scan running - switch RUN on to start one (it runs in the "
                                              "background; Grasshopper stays usable)", "progress": 0.0})
    rising, st["run"] = bool(run) and not st["run"], bool(run)
    stop, st["cancel"] = bool(cancel) and not st["cancel"], bool(cancel)
    h = st["handle"]
    if stop and bj.running(h):
        bj.cancel(h)
    if rising and not bj.running(h):
        h = st["handle"] = bj.start("scan", params, os.path.join(folder, "_jobs"), core_dir)
    if h is not None:
        s = bj.status(h)
        st["status"], st["progress"] = bj.text(s), float(s.get("fraction") or 0.0)
        comp.Message = bj.message(s)
        if s["state"] in ("starting", "running"):
            _schedule(comp, 1500, lambda doc: comp.ExpireSolution(False), key + ("tick",))
        elif s["state"] == "done" and not h["loaded"]:
            h["loaded"] = True
            st["outputs"] = _outputs(core, bj.result(h))

            def refresh(doc):                             # the preview and the time-lapse read the new files
                for o in doc.Objects:
                    if getattr(o, "NickName", "") in ("3 PREVIEW HOUR", "5 TIME-LAPSE CLOCK"):
                        o.ExpireSolution(False)
            _schedule(comp, 10, refresh, key + ("refresh",))
    out = dict(st["outputs"] or {})
    out["status"], out["progress"] = st["status"], st["progress"]
    return out


_res = main() or {}
for _n in OUTPUT_NAMES:
    if _n in _res:
        globals()[_n] = _res[_n]
# ---------- end _2_run_scan ----------
scan_report = Panel(_2_run_scan.report)
this_scan_s_report_page_open_in_a_browse = Panel(_2_run_scan.report_html)  # "this scan's report page (open in a browser)"
scan_status_progress = Panel(_2_run_scan.status)
